# Grasshopper definition FacadeEmbed_JinQiao_Podium.gh (Grasshopper 1.0.7)
# plug-ins: EleFront, Wombat, Pufferfish, TT Toolbox, Hare, ClipperComponents

# ----
# 线段延长长度
number_slider = Slider(1001, range=0..10000)  # disabled

# ----
# remove duplicate curves
geo = Geometry()  # disabled
number_slider_2 = Slider(0.1, range=0..0.1)  # disabled
boundary = BoundarySurfaces(Edges=geo)  # disabled
area = Area(Geometry=boundary)  # -> Area, Centroid; disabled
cullduppoints = RemoveDuplicatePoints(InputPoints=area.Centroid, Tolerance=number_slider_2)  # -> OutputPoints, FirstPointIndexes; disabled
null = NullItem(Item=cullduppoints.FirstPointIndexes)  # -> NullFlags, InvalidFlags, Description; disabled
dispatch = Dispatch(List=boundary, DispatchPattern=null.NullFlags)  # -> ListA, ListB; disabled
geo_2 = Geometry(dispatch.ListA)  # disabled

# ----
# 调换阴阳角设定
toggle = BooleanToggle(False)  # disabled

# ----
# 单体选型
list = ValueList({"板埋": 0, "槽埋": 1, "板槽埋": 2}, selected="槽埋")
list_2 = ValueList({"顶埋": 0, "侧埋": 1}, selected="顶埋")
panel = Panel(list)
panel_2 = Panel(list_2)

# ----
# （1）导入埋件定位点
# Block & Curve的形式
# block names
listblockd = ListBlockDocument()
panel_3 = Panel(listblockd)

# ----
# 1.输入block names
data = Data(["PX-GLAZ-F2$0$PX-GLAZ-F2$0$fin", "PX-GLAZ-F2$0$PX-GLAZ-F1$0$fin"])
panel_4 = Panel(data)

# ----
# （0）Prep
# 检测Block的Plane
# block names
listblockd_2 = ListBlockDocument()
panel_6 = Panel(listblockd_2)
refblock = ReferenceBlockByName(BlockName=panel_4)
deblock = DeconstructBlock(Block=refblock)  # -> Name, Plane, Geometry

# ----
# Input Blocks (Correct Plan)
# 主体定位点
# Later:
# 1.Block -Plane-不同方向合并处理
# 
# 2.双层幕墙的处理
data_2 = Data(["PX-GLAZ-F2$0$PX-GLAZ-F1$0$标准块", "PX-GLAZ-F2$0$PX-GLAZ-F2$0$标准块", "PX-GLAZ-F2$0$PX-GLAZ-F3$0$标准块"])

# ----
# Input Curves
# 主体定位点（按图层导入）
crv = Curve(<curve referenced from the Rhino model>)

# ----
# Input Blocks (Wrong Plan)
# 主体定位点
data_3 = Data("PX-GLAZ-F2$0$T3T")

# ----
# 按图层整理curves
# 2.Line-0-建筑
# 3.Line-1-结构
panel_7 = Panel("Line-0-建筑-Whole")
reflay = ReferenceByLayer(LayerName=panel_7)
reflay_2 = ReferenceByLayer(LayerName="Line-1-檐口")
reflay_3 = ReferenceByLayer(LayerName="Line-1-结构-Out")
reflay_4 = ReferenceByLayer(LayerName="Line-1-结构-All")

# ---- group: 结构线
crv_2 = Curve(<curve referenced from the Rhino model>)

# ----
# 平面定位INPUT
crv_3 = Curve([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])

# ---- group: 玻璃线
玻璃线 = Curve(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)
玻璃线_2 = Curve(<curve referenced from the Rhino model>)
玻璃线_3 = Curve(<curve referenced from the Rhino model>)

# ---- group: 定位竖料
crv_4 = Curve([<curve referenced from the Rhino model> x300])
crv_5 = Curve([<curve referenced from the Rhino model> x180])
crv_6 = Curve([<curve referenced from the Rhino model> x383])

# ----
# 按图层整理curves
# 1.Line-1-建筑-
panel_8 = Panel("Line-1-建筑-Curve-hasAngle")
reflay_5 = ReferenceByLayer(LayerName="Line-1-建筑-SmoothCurve")
reflay_6 = ReferenceByLayer(LayerName="Line-1-建筑-Curve_withLocation")
reflay_7 = ReferenceByLayer(LayerName=panel_8)
reflay_8 = ReferenceByLayer(LayerName="Line-1-建筑-Whole")

# ----
# This Project Only
panel_9 = Panel("Line-1-建筑-SpecialCurve")
reflay_9 = ReferenceByLayer(LayerName=panel_9)

# ---- group: 混凝土
# 板埋几何INPUT
list_3 = ValueList({"C15": 0, "C20": 1, "C25": 2, "C30": 3, "C35": 4, "C40": 5}, selected="C35")

# ---- group: 钢筋牌号
list_4 = ValueList({"HPB300": 0, "HRB400": 1}, selected="HPB300")

# ---- group: 直径
list_5 = ValueList({"10": 0, "12": 1, "16": 2, "18": 3, "20": 4, "25": 5}, selected="12")

# ---- group: 列
list_6 = ValueList({"2X": 0, "3X": 1, "4X": 2}, selected="3X")

# ---- group: 行
list_7 = ValueList({"2Y": 0, "3Y": 1, "4Y": 2}, selected="2Y")

# ---- group: 锚筋间距
s_x = Slider(22, range=14..60, expression="X*5")
s_y = Slider(22, range=14..60, expression="X*5")

# ----
crv_7 = Curve([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])

# ----
# 第一层
layer = ObjectLayer(Guid=crv)  # -> LayerIndex, LayerPathName
panel_10 = Panel(data_2)
panel_12 = Panel(layer.LayerPathName)
refblock_2 = ReferenceBlockByName(BlockName=panel_10)
reflay_10 = ReferenceByLayer(LayerName=panel_12)
xy = XYPlane(Origin=Point(0, 0, 0))
xy_2 = XYPlane(Origin=Point(0, 0, 0))
project = Project(Geometry=refblock_2, Plane=xy_2)  # -> Geometry, Transform
project_2 = Project(Geometry=reflay_10, Plane=xy)  # -> Geometry, Transform

# ----
# 槽埋-角部选择
list_8 = ValueList({"槽埋角部-L形": 0, "槽埋角部-I形": 1}, selected="槽埋角部-I形")

join = JoinCurves(Curves=crv_7, Preserve=False)
panel_13 = Panel(data_3)

# ----
# （2）导入参考线
# 按照图层导入建筑、结构、檐口线
xy_3 = XYPlane(Origin=Point(0, 0, 0))
xy_4 = XYPlane(Origin=Point(0, 0, 0))
xy_5 = XYPlane(Origin=Point(0, 0, 0))
xy_6 = XYPlane(Origin=Point(0, 0, 0))
xy_7 = XYPlane(Origin=Point(0, 0, 0))
xy_8 = XYPlane(Origin=Point(0, 0, 0))
xy_9 = XYPlane(Origin=Point(0, 0, 0))
xy_10 = XYPlane(Origin=Point(0, 0, 0))
xy_11 = XYPlane(Origin=Point(0, 0, 0))
project_3 = Project(Geometry=reflay_5, Plane=xy_3)  # -> Geometry, Transform
project_4 = Project(Geometry=reflay_6, Plane=xy_4)  # -> Geometry, Transform
project_5 = Project(Geometry=reflay_7, Plane=xy_5)  # -> Geometry, Transform
project_6 = Project(Geometry=reflay_8, Plane=xy_6)  # -> Geometry, Transform
project_7 = Project(Geometry=reflay_9, Plane=xy_7)  # -> Geometry, Transform
project_8 = Project(Geometry=reflay_3, Plane=xy_9)  # -> Geometry, Transform
project_9 = Project(Geometry=reflay, Plane=xy_10)  # -> Geometry, Transform
project_10 = Project(Geometry=reflay_2, Plane=xy_8)  # -> Geometry, Transform
project_11 = Project(Geometry=reflay_4, Plane=xy_11)  # -> Geometry, Transform
crv_8 = Curve(project_4.Geometry)
crv_9 = Curve(project_3.Geometry)
crv_10 = Curve(project_5.Geometry)
crv_11 = Curve(project_6.Geometry)
crv_12 = Curve(project_8.Geometry)
crv_13 = Curve(project_11.Geometry)
crv_14 = Curve(project_9.Geometry)
crv_15 = Curve(project_10.Geometry)

flip = FlipCurve(Curve=玻璃线)  # -> Curve, Flag
boundary_2 = BoundarySurfaces(Edges=join)

# ----
# 2.检测plane是否存在
pln = Plane(deblock.Plane)

filter = StreamFilter(Gate=Toggle(True), Stream0=玻璃线, Stream1=flip.Curve)
sunion = SolidUnion(Breps=boundary_2)
refblock_3 = ReferenceBlockByName(BlockName=panel_13)
offset = OffsetCurve(Curve=filter, Distance=expr("-x", Slider(375, range=0..1000)), Corners=1)
area_2 = Area(Geometry=sunion)  # -> Area, Centroid

# ----
# 3.如果不存在则Blake geometry
# 并在rhino里面清理线段
geo_3 = Geometry(deblock.Geometry)

pt = Point(area_2.Centroid)
explode = Explode(Curve=offset, Recursive=True)  # -> Segments, Vertices
xy_12 = XYPlane(Origin=Point(0, 0, 0))
pt_2 = Point(explode.Vertices)
entwine = Entwine(Branch00=sunion, Branch01=pt, FlattenInputs=True)
max = Maximum(A=s_x, B=s_y)
project_12 = Project(Geometry=refblock_3, Plane=xy_12)  # -> Geometry, Transform
flip_2 = FlipMatrix(Data=entwine)
filter_2 = StreamFilter(Gate=list_3, Stream0=7.2, Stream1=9.6, Stream2=11.9, Stream3=14.3, Stream4=16.7, Stream5=19.1)
filter_3 = StreamFilter(Gate=list_4, Stream0=270, Stream1=360)
filter_4 = StreamFilter(Gate=list_5, Stream0=10, Stream1=12, Stream2=16, Stream3=18, Stream4=20, Stream5=25)
filter_5 = StreamFilter(Gate=list_3, Stream0=0.91, Stream1=1.1, Stream2=1.27, Stream3=1.43, Stream4=1.57, Stream5=1.71)
filter_6 = StreamFilter(Gate=list_4, Stream0=0.16, Stream1=0.14)
addition = Addition(A=list_6, B=1)
addition_2 = Addition(A=list_7, B=1)
division = Division(A=max, B=8)

# ----
# 测试Smooth Curve是否与每个Block相切
# remove duplicate blocks
deblock_2 = DeconstructBlock(Block=project.Geometry)  # -> Name, Plane, Geometry
pln_2 = Plane(flatten(deblock_2.Plane))
deplane = DeconstructPlane(Plane=pln_2)  # -> Origin, XAxis, YAxis, ZAxis
cullduppoints_2 = RemoveDuplicatePoints(InputPoints=deplane.Origin, Tolerance=0.001)  # -> OutputPoints, FirstPointIndexes
null_2 = NullItem(Item=cullduppoints_2.FirstPointIndexes)  # -> NullFlags, InvalidFlags, Description
dispatch_2 = Dispatch(List=pln_2, DispatchPattern=null_2.InvalidFlags)  # -> ListA, ListB
dispatch_3 = Dispatch(List=flatten(project.Geometry), DispatchPattern=null_2.InvalidFlags)  # -> ListA, ListB
pln_3 = Plane(dispatch_2.ListA)

# ----
# 测试Smooth Curve是否与每个Block相切
# remove duplicate blocks
deblock_3 = DeconstructBlock(Block=project_12.Geometry)  # -> Name, Plane, Geometry
pln_4 = Plane(flatten(deblock_3.Plane))
deplane_2 = DeconstructPlane(Plane=pln_4)  # -> Origin, XAxis, YAxis, ZAxis
cullduppoints_3 = RemoveDuplicatePoints(InputPoints=deplane_2.Origin, Tolerance=0.001)  # -> OutputPoints, FirstPointIndexes
null_3 = NullItem(Item=cullduppoints_3.FirstPointIndexes)  # -> NullFlags, InvalidFlags, Description
dispatch_4 = Dispatch(List=pln_4, DispatchPattern=null_3.InvalidFlags)  # -> ListA, ListB
dispatch_5 = Dispatch(List=flatten(project_12.Geometry), DispatchPattern=null_3.InvalidFlags)  # -> ListA, ListB
pln_5 = Plane(dispatch_4.ListA)

# ---- group: 建筑定位轮廓
item = ListItem(List=flip_2, Index="0", Wrap=True)  # -> flatten(Item)

# ---- group: 埋件定位点
item_2 = ListItem(List=flip_2, Index="-1", Wrap=True)  # -> flatten(Item)

# ----
t = Integer(division)
panel_14 = Panel(filter_5)
panel_15 = Panel(filter_2)
panel_16 = Panel(filter_6)
min = Minimum(A=filter_3, B=300)
panel_17 = Panel(min)

deblock_4 = DeconstructBlock(Block=dispatch_3.ListA)  # -> Name, Plane, Geometry
data_4 = Data(dispatch_3.ListA)

deblock_5 = DeconstructBlock(Block=dispatch_5.ListA)  # -> Name, Plane, Geometry
data_5 = Data(dispatch_5.ListA)

expression = Expression(A=filter_6, fy=filter_3, ft=filter_5, d=filter_4, Expression="(int((0.6*1.1*A*fy/ft*d)/5)+1)*5")

data_6 = Data(flatten(pln_3))
deplane_3 = DeconstructPlane(Plane=data_6)  # -> Origin, XAxis, YAxis, ZAxis
pln_6 = Plane(data_6)
amp = Amplitude(Vector=deplane_3.YAxis, Amplitude=Slider(300, range=0..1000))
move = Move(Geometry=deplane_3.Origin, Motion=amp)  # -> Geometry, Transform
ln = Line(StartPoint=deplane_3.Origin, EndPoint=move.Geometry)
crv_16 = Curve(crv_9)
midpt = CurveMiddle(Curve=ln)
scale = Scale(Geometry=ln, Center=midpt, Factor=Slider(7.8, range=0..10))  # -> Geometry, Transform
merge = Merge(Data1=scale.Geometry, Data2=crv_16)
mcx = MultipleCurves(Curves=flatten(merge))  # -> Points, IndexA, IndexB, ParamA, ParamB

data_7 = Data(flatten(pln_5))
deplane_4 = DeconstructPlane(Plane=data_7)  # -> Origin, XAxis, YAxis, ZAxis
pln_7 = Plane(data_7)
amp_2 = Amplitude(Vector=deplane_4.YAxis, Amplitude=Slider(300, range=0..1000))
move_2 = Move(Geometry=deplane_4.Origin, Motion=amp_2)  # -> Geometry, Transform
ln_2 = Line(StartPoint=deplane_4.Origin, EndPoint=move_2.Geometry)
crv_17 = Curve(crv_9)
midpt_2 = CurveMiddle(Curve=ln_2)
scale_2 = Scale(Geometry=ln_2, Center=midpt_2, Factor=Slider(7.8, range=0..10))  # -> Geometry, Transform
merge_2 = Merge(Data1=scale_2.Geometry, Data2=crv_17)
mcx_2 = MultipleCurves(Curves=flatten(merge_2))  # -> Points, IndexA, IndexB, ParamA, ParamB

# ----
# 导入槽埋模型
brep = Brep(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)

# ---- group: 槽埋
# 槽埋Modeling
brep_2 = Brep(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)
bbox = BoundingBox(Content=brep, Plane=PlaneXY(0, 0, 0))  # -> Box, Box_2
debox = DeconstructBox(Box=bbox.Box)  # -> Plane, X, Y, Z
area_3 = Area(Geometry=brep)  # -> Area, Centroid
pdecon = Deconstruct(Point=area_3.Centroid)  # -> XComponent, YComponent, ZComponent
dedomain = DeconstructDomain(Domain=debox.Z)  # -> Start, End
xy_13 = XYPlane(Origin=Point(0, 0, 0))
pt_3 = ConstructPoint(XCoordinate=pdecon.XComponent, YCoordinate=pdecon.YComponent, ZCoordinate=dedomain.End)
pl_origin = PlaneOrigin(Base=xy_13, Origin=pt_3)
xy_14 = XYPlane(Origin=Point(0, 0, 0))
orient = Orient(Geometry=brep, Source=pl_origin, Target=xy_14)  # -> Geometry, Transform

# ----
# blocks + special curves
cull_i = CullIndex(List=flatten(pln_6), Indices=mcx.IndexA, Wrap=True)
cull_i_2 = CullIndex(List=flatten(data_4), Indices=mcx.IndexA, Wrap=True)
pln_8 = Plane(cull_i)
data_8 = Data(cull_i_2)

# ----
# blocks + special curves
cull_i_3 = CullIndex(List=flatten(pln_7), Indices=mcx_2.IndexA, Wrap=True)
cull_i_4 = CullIndex(List=flatten(data_5), Indices=mcx_2.IndexA, Wrap=True)
pln_9 = Plane(cull_i_3)
data_9 = Data(cull_i_4)

# ----
# blocks + smooth curves
item_3 = ListItem(List=pln_6, Index=mcx.IndexA, Wrap=True)
item_4 = ListItem(List=flatten(data_4), Index=mcx.IndexA, Wrap=True)
data_10 = Data(item_4)
pln_10 = Plane(item_3)

# ----
# blocks + smooth curves
item_5 = ListItem(List=pln_7, Index=mcx_2.IndexA, Wrap=True)
item_6 = ListItem(List=flatten(data_5), Index=mcx_2.IndexA, Wrap=True)
data_11 = Data(item_6)
pln_11 = Plane(item_5)

edges = BrepEdges(Brep=bbox.Box)  # -> Naked, Interior, NonManifold
item_7 = ListItem(List=edges.Interior, Index="5", Wrap=True)
item_8 = ListItem(List=edges.Interior, Index="4", Wrap=True)
clx = CurveLine(Curve=item_8, Line=item_7)  # -> Points, Params, Count
Y = UnitY(Factor=item_7)
rotate = Rotate(Geometry=brep, Angle=1.570796327, Plane=clx.Points)  # -> Geometry, Transform
move_3 = Move(Geometry=rotate.Geometry, Motion=Y)  # -> Geometry, Transform
merge_3 = Merge(Data1=brep, Data2=move_3.Geometry)  # -> flatten(Result)
sunion_2 = SolidUnion(Breps=merge_3)
bbox_2 = BoundingBox(Content=sunion_2, Plane=PlaneXY(0, 0, 0))  # -> Box, Box_2
area_4 = Area(Geometry=sunion_2)  # -> Area, Centroid
debox_2 = DeconstructBox(Box=bbox_2.Box)  # -> Plane, X, Y, Z
pdecon_2 = Deconstruct(Point=area_4.Centroid)  # -> XComponent, YComponent, ZComponent
dedomain_2 = DeconstructDomain(Domain=debox_2.Z)  # -> Start, End
pt_4 = ConstructPoint(XCoordinate=pdecon_2.XComponent, YCoordinate=pdecon_2.YComponent, ZCoordinate=dedomain_2.End)
xy_15 = XYPlane(Origin=Point(0, 0, 0))
pl_origin_2 = PlaneOrigin(Base=xy_15, Origin=pt_4)
xy_16 = XYPlane(Origin=Point(0, 0, 0))
orient_2 = Orient(Geometry=sunion_2, Source=pl_origin_2, Target=xy_16)  # -> Geometry, Transform

# ----
# 导入槽埋模型
brep_3 = Brep(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)

# ----
# remove duplicate curves
geo_4 = Geometry(project_2.Geometry)
boundary_3 = BoundarySurfaces(Edges=geo_4)
area_5 = Area(Geometry=boundary_3)  # -> Area, Centroid
cullduppoints_4 = RemoveDuplicatePoints(InputPoints=area_5.Centroid, Tolerance=Slider(0.1, range=0..0.1))  # -> OutputPoints, FirstPointIndexes
null_4 = NullItem(Item=cullduppoints_4.FirstPointIndexes)  # -> NullFlags, InvalidFlags, Description
dispatch_6 = Dispatch(List=boundary_3, DispatchPattern=null_4.NullFlags)  # -> ListA, ListB
geo_5 = Geometry(dispatch_6.ListA)

# ----
# 第一层
# 
# Special Curves(architecture line)
crv_18 = Curve(crv_8)
pln_12 = Plane(pln_8)
deplane_5 = DeconstructPlane(Plane=pln_12)  # -> Origin, XAxis, YAxis, ZAxis
disc = Discontinuity(Curve=crv_18, Level=1)  # -> Points, Parameters
pull = PullPoint(Point=deplane_5.Origin, Geometry=disc.Points, ClosestOnly=True)  # -> ClosestPoint, Distance
sort = SortList(Keys=pull.Distance)  # -> reverse(Keys), ValuesA
panel_18 = Panel(sort.Keys)
larger = LargerThan(FirstNumber=pull.Distance, SecondNumber=Slider(300, range=0..1000))  # -> LargerThan, OrEqualTo
dispatch_7 = Dispatch(List=pln_12, DispatchPattern=larger.LargerThan)  # -> ListA, ListB
data_12 = Data(dispatch_7.ListB)
deplane_6 = DeconstructPlane(Plane=data_12)  # -> Origin, XAxis, YAxis, ZAxis
pull_2 = PullPoint(Point=deplane_6.Origin, Geometry=disc.Points, ClosestOnly=True)  # -> ClosestPoint, Distance

filter_7 = StreamFilter(Gate=list_8, Stream0=orient_2.Geometry, Stream1=orient.Geometry)
crv_19 = Curve(crv_9)
entwine_2 = Entwine(Branch00=orient.Geometry, Branch01=filter_7, FlattenInputs=True)
crv_20 = Curve(crv_9)
crv_21 = Curve(crv_9)
crv_22 = Curve(offset)

# ----
# Special Curve(with location)- All
pl = ConstructPlane(Origin=pull_2.ClosestPoint, XAxis=deplane_6.XAxis, YAxis=deplane_6.YAxis)

crv_23 = Curve([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])
crv_24 = Curve(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)
merge_4 = Merge(Data1=crv_23, Data2=crv_24)
crv_25 = Curve(crv_12)

disc_2 = Discontinuity(Curve=crv_25, Level=1)  # -> flatten(Points), Parameters
graft = GraftTree(Tree=disc_2.Points, IncludeEmptyLists=True, IncludeNullItems=True)
ln_3 = Line(StartPoint=disc_2.Points, EndPoint=graft)
len = Length(Curve=ln_3)
sort_2 = SortList(Keys=len, ValuesA=ln_3)  # -> Keys, ValuesA
item_9 = ListItem(List=sort_2.ValuesA, Index="1", Wrap=True)  # -> flatten(Item)
len_2 = Length(Curve=item_9)
larger_2 = LargerThan(FirstNumber=len_2, SecondNumber=Slider(500, range=0..1000))  # -> LargerThan, OrEqualTo
dispatch_8 = Dispatch(List=item_9, DispatchPattern=larger_2.LargerThan)  # -> ListA, ListB

# ----
# Join Curves
line = Line(dispatch_8.ListB)

# ----
# 1/2梁宽
# 给多少？？
number_slider_3 = Slider(150, range=0..1000)

# ----
# 下层幕墙边线在结构边梁以内>350
# （最外层结构线）
number_slider_4 = Slider(350, range=0..1000)

# ----
# 1.2是否有吊顶
crv_26 = Curve(crv_25)
crv_27 = Curve(crv_15)
offset_2 = OffsetCurve(Curve=crv_26, Distance=expr("-x", number_slider_3), Corners=1)
offset_3 = OffsetCurve(Curve=crv_26, Distance=number_slider_3, Corners=1)
midpt_3 = CurveMiddle(Curve=offset_3)
midpt_4 = CurveMiddle(Curve=flatten(offset_2))
midpt_5 = CurveMiddle(Curve=flatten(crv_26))
pull_3 = PullPoint(Point=midpt_5, Geometry=crv_27, ClosestOnly=True)  # -> ClosestPoint, Distance
pull_4 = PullPoint(Point=midpt_5, Geometry=flatten(midpt_3), ClosestOnly=True)  # -> ClosestPoint, Distance
pull_5 = PullPoint(Point=midpt_5, Geometry=flatten(midpt_4), ClosestOnly=True)  # -> ClosestPoint, Distance
ln_4 = Line(StartPoint=pull_3.ClosestPoint, EndPoint=pull_4.ClosestPoint)
ln_5 = Line(StartPoint=pull_3.ClosestPoint, EndPoint=pull_5.ClosestPoint)
ccx = CurveCurve(CurveA=graft(ln_4), CurveB=crv_26)  # -> Points, ParamsA, ParamsB
pshift = ShiftPaths(Data=ccx.Points, Offset=-1)
null_5 = NullItem(Item=pshift)  # -> NullFlags, flatten(InvalidFlags), Description
dispatch_9 = Dispatch(List=crv_26, DispatchPattern=null_5.InvalidFlags)  # -> ListA, ListB
data_13 = Data(dispatch_9.ListA)
data_14 = Data(dispatch_9.ListB)
addition_3 = Addition(A=number_slider_3, B=number_slider_4)
offset_4 = OffsetCurve(Curve=data_13, Distance=expr("-x", addition_3), Corners=1)
offset_5 = OffsetCurve(Curve=data_14, Distance=addition_3, Corners=1)

# ----
# 内测梁边线
merge_5 = Merge(Data1=offset_4, Data2=offset_5)

crv_28 = Curve(crv_14)

# ----
# 根据F1+F2建筑线制作轮廓线
number_slider_5 = Slider(2000, range=0..10000)
crv_29 = Curve(crv_11)
close = CloseCurve(Curve=crv_29, Tolerance=0)
offset_6 = OffsetCurve(Curve=crv_29, Distance=number_slider_5, Corners=1)
crv_30 = Curve(crv_14)
boundary_4 = BoundarySurfaces(Edges=close)
boundary_5 = BoundarySurfaces(Edges=crv_30)
polyboolean = PolylineBoolean(
    A=boundary_4,
    B=boundary_5,
    BooleanType="1",
    Plane=Plane(origin=(0, 0, 0), x=(0, 0, 0), y=(0, 0, 0)),
    Tolerance=0.001,
    EvenOdd=True)
smoothpline = SmoothPolyline(Polyline=polyboolean, Strength=1, Times=1)
smoothpline_2 = SmoothPolyline(Polyline=smoothpline, Strength=1, Times=1)
offset_7 = OffsetCurve(Curve=smoothpline_2, Distance=Slider(5139, range=0..10000), Corners=1)

# ----
# 下层建筑边线内侧300-600mm范围内
number_slider_6 = Slider(600, range=0..1000)
crv_31 = Curve(crv_28)
offset_8 = OffsetCurve(Curve=crv_31, Distance=expr("-x", number_slider_6), Corners=1)
offset_9 = OffsetCurve(Curve=crv_31, Distance=expr("-x", Slider(300, range=0..1000)), Corners=1)

# ----
# 下层建筑边线外侧50-350mm范围内
number_slider_7 = Slider(50, range=0..100)
crv_32 = Curve(crv_28)
offset_10 = OffsetCurve(Curve=crv_32, Distance=number_slider_7, Corners=1)
offset_11 = OffsetCurve(Curve=crv_32, Distance=Slider(350, range=0..1000), Corners=1)

# ----
# 梁宽根据tag
number_slider_8 = Slider(150, range=0..1000)

# ----
# remove wrong lines
number_slider_9 = Slider(600, range=0..1000)

# ----
# 区分内外梁边线
crv_33 = Curve(crv_13)
offcrv = OffsetCurve(
    Curve=crv_33,
    Plane=PlaneXY(0, 0, 0),
    Distance=number_slider_8,
    BothSides=expr("-x", number_slider_8),
    Kinks=0,
    CapType="0")
crv_34 = Curve(offcrv)
midpt_6 = CurveMiddle(Curve=offcrv)
midpt_7 = CurveMiddle(Curve=crv_33)
item_10 = ListItem(List=midpt_6, Index=0, Wrap=True)
item_11 = ListItem(List=crv_34, Index=0, Wrap=True)
item_12 = ListItem(List=crv_34, Index="-1", Wrap=True)
pull_6 = PullPoint(Point=midpt_7, Geometry=offset_7, ClosestOnly=True)  # -> ClosestPoint, Distance
ln_6 = Line(StartPoint=item_10, EndPoint=graft(pull_6.ClosestPoint))
graft_2 = GraftTree(Tree=crv_33, IncludeEmptyLists=True, IncludeNullItems=True)
ccx_2 = CurveCurve(CurveA=ln_6, CurveB=graft_2)  # -> Points, ParamsA, ParamsB
null_6 = NullItem(Item=ccx_2.Points)  # -> NullFlags, InvalidFlags, Description
dispatch_10 = Dispatch(List=item_12, DispatchPattern=null_6.InvalidFlags)  # -> ListA, ListB
dispatch_11 = Dispatch(List=item_11, DispatchPattern=null_6.InvalidFlags)  # -> ListA, ListB

# ----
# remove wrong lines
number_slider_10 = Slider(600, range=0..1000)

# ----
# 梁边线-内
merge_6 = Merge(Data1=dispatch_11.ListB, Data2=dispatch_10.ListA)

# ----
# 梁边线-外
merge_7 = Merge(Data1=dispatch_11.ListA, Data2=dispatch_10.ListB)

# ----
# 求内部曲线转折点
crv_35 = Curve()  # disabled
number_slider_11 = Slider(300, range=0..1000)  # disabled
neg = Negative(Value=number_slider_11)  # disabled
filter_8 = StreamFilter(Gate=toggle, Stream0=number_slider_11, Stream1=neg)  # disabled
number_slider_12 = Slider(60, range=0..100)  # disabled

ext = ExtendCurve(Curve=crv_35, Type=0, Start=number_slider, End=number_slider)  # disabled

# ----
# 第二层
# 
# Curves(location point)+ Smooth Curves(architecture line)
# 第二层-区分阴阳角
area_6 = Area(Geometry=geo_2)  # -> Area, Centroid; disabled
crv_36 = Curve(crv_35)  # disabled
pull_7 = PullPoint(Point=area_6.Centroid, Geometry=crv_36, ClosestOnly=True)  # -> ClosestPoint, Distance; disabled
number_slider_13 = Slider(200, range=0..1000)  # disabled
number_slider_14 = Slider(100, range=0..300)  # disabled

# ----
# 第二层-阴阳角
panel_19 = Panel("0.5 * Pi")  # disabled
toggle_2 = BooleanToggle(True)  # disabled
neg_2 = Negative(Value=panel_19)  # disabled
filter_9 = StreamFilter(Gate=toggle_2, Stream0=panel_19, Stream1=neg_2)  # disabled

# ----
# 第二层-大面定位
panel_20 = Panel("0.5 * Pi")  # disabled
toggle_3 = BooleanToggle(True)  # disabled
neg_3 = Negative(Value=panel_20)  # disabled
filter_10 = StreamFilter(Gate=toggle_3, Stream0=panel_20, Stream1=neg_3)  # disabled

number_slider_15 = Slider(300, range=0..1000)  # disabled
number_slider_16 = Slider(1.5, range=0..10)  # disabled

number_slider_17 = Slider(300, range=0..1000)  # disabled
number_slider_18 = Slider(1.5, range=0..10)  # disabled

number_slider_19 = Slider(300, range=0..1000)  # disabled
number_slider_20 = Slider(1.5, range=0..10)  # disabled

# ----
# 显示"False"时要选择线段延长
list_9 = ValueList({"线段不延长": 0, "线段延长": 1}, selected="线段延长")  # disabled

filter_11 = StreamFilter(Gate=list_9, Stream0=crv_35, Stream1=ext)  # disabled

disc_3 = Discontinuity(Curve=graft(filter_11), Level=1)  # -> Points, Parameters; disabled
crv_cp = CurveClosestPoint(Point=disc_3.Points, Curve=graft(filter_11))  # -> Point, Parameter, Distance; disabled
eval = EvaluateCurve(Curve=graft(filter_11), Parameter=crv_cp.Parameter)  # -> flatten(Point), Tangent, flatten(Angle); disabled
deg = Degrees(Radians=eval.Angle)  # disabled
offset_12 = OffsetCurve(Curve=filter_11, Distance=expr("-X", filter_8), Corners=1)  # disabled
panel_21 = Panel(deg)  # disabled
larger_3 = LargerThan(FirstNumber=deg, SecondNumber=number_slider_12)  # -> LargerThan, OrEqualTo; disabled
disc_4 = Discontinuity(Curve=offset_12, Level=1)  # -> flatten(Points), Parameters; disabled
dispatch_12 = Dispatch(List=eval.Point, DispatchPattern=larger_3.LargerThan)  # -> ListA, ListB; disabled
end = EndPoints(Curve=filter_11)  # -> Start, End; disabled
data_15 = Data(dispatch_12.ListA)  # disabled
pull_8 = PullPoint(Point=data_15, Geometry=flatten(offset_12), ClosestOnly=True)  # -> ClosestPoint, Distance; disabled
testpoint = TestPoint(archPoint=pull_8.ClosestPoint, crvPoint=disc_4.Points)  # -> out, specialPt; inputs archPoint: list of Point3d, crvPoint: list of Point3d; disabled
# ---------- testpoint: C# ----------
    List<int> passIndex = new List<int>();

    for(int i = 0; i < archPoint.Count; i++){
      foreach(Point3d t in crvPoint){
        if(archPoint[i].X == t.X && archPoint[i].Y == t.Y && archPoint[i].Z == t.Z){
          Print("pass");
          passIndex.Add(i);}
      }
    }

    specialPt = passIndex;
# ---------- end testpoint ----------

# ----
# 阴角
item_13 = ListItem(List=data_15, Index=testpoint.specialPt, Wrap=True)  # disabled

# ----
# SmoothCurve-阴角&阳角
# 阳角
cull_i_5 = CullIndex(List=data_15, Indices=testpoint.specialPt, Wrap=True)  # disabled

dist = Distance(PointA=pull_7.ClosestPoint, PointB=data_15)  # disabled
sort_3 = SortList(Keys=dist)  # -> Keys, ValuesA; disabled
panel_22 = Panel(sort_3.Keys)  # disabled
smaller = SmallerThan(FirstNumber=dist, SecondNumber=number_slider_13)  # -> SmallerThan, OrEqualTo; disabled
dispatch_13 = Dispatch(List=geo_2, DispatchPattern=smaller.SmallerThan)  # -> ListA, ListB; disabled
crv_37 = Curve(filter_11)  # disabled

data_16 = Data(dispatch_13.ListA)  # disabled
explode_2 = Explode(Curve=data_16, Recursive=True)  # -> Segments, Vertices; disabled
len_3 = Length(Curve=explode_2.Segments)  # disabled
sort_4 = SortList(Keys=reverse(len_3), ValuesA=explode_2.Segments)  # -> Keys, ValuesA; disabled
item_14 = ListItem(List=sort_4.ValuesA, Index=0, Wrap=True)  # -> flatten(Item); disabled
area_7 = Area(Geometry=data_16)  # -> Area, Centroid; disabled
midpt_8 = CurveMiddle(Curve=item_14)  # disabled
move2pt = MoveToPoint(Geometry=item_14, PointA=midpt_8, PointB=area_7.Centroid)  # -> Moved, Vector, Transform; disabled
end_2 = EndPoints(Curve=move2pt.Moved)  # -> Start, End; disabled
ln_7 = Line(StartPoint=end_2.Start, EndPoint=end_2.End)  # disabled
xy_17 = XYPlane(Origin=end_2.End)  # disabled
rotate_2 = Rotate(Geometry=ln_7, Angle=filter_9, Plane=xy_17)  # -> Geometry, Transform; disabled
pl_2 = ConstructPlane(Origin=end_2.End, XAxis=rotate_2.Geometry, YAxis=ln_7)  # disabled

data_17 = Data(dispatch_13.ListB)  # disabled
explode_3 = Explode(Curve=data_17, Recursive=True)  # -> Segments, Vertices; disabled
len_4 = Length(Curve=explode_3.Segments)  # disabled
sort_5 = SortList(Keys=reverse(len_4), ValuesA=explode_3.Segments)  # -> Keys, ValuesA; disabled
item_15 = ListItem(List=sort_5.ValuesA, Index=0, Wrap=True)  # -> flatten(Item); disabled
area_8 = Area(Geometry=data_17)  # -> Area, Centroid; disabled
midpt_9 = CurveMiddle(Curve=item_15)  # disabled
move2pt_2 = MoveToPoint(Geometry=item_15, PointA=midpt_9, PointB=area_8.Centroid)  # -> Moved, Vector, Transform; disabled
end_3 = EndPoints(Curve=move2pt_2.Moved)  # -> Start, End; disabled
ln_8 = Line(StartPoint=end_3.Start, EndPoint=end_3.End)  # disabled
xy_18 = XYPlane(Origin=end_3.End)  # disabled
rotate_3 = Rotate(Geometry=ln_8, Angle=filter_10, Plane=xy_18)  # -> Geometry, Transform; disabled
pl_3 = ConstructPlane(Origin=end_3.End, XAxis=rotate_3.Geometry, YAxis=ln_8)  # disabled

data_18 = Data(flatten(pl_3))  # disabled
deplane_7 = DeconstructPlane(Plane=data_18)  # -> Origin, XAxis, YAxis, ZAxis; disabled
amp_3 = Amplitude(Vector=deplane_7.YAxis, Amplitude=number_slider_17)  # disabled
move_4 = Move(Geometry=deplane_7.Origin, Motion=amp_3)  # -> Geometry, Transform; disabled
ln_9 = Line(StartPoint=deplane_7.Origin, EndPoint=move_4.Geometry)  # disabled
midpt_10 = CurveMiddle(Curve=ln_9)  # disabled
scale_3 = Scale(Geometry=ln_9, Center=midpt_10, Factor=number_slider_18)  # -> Geometry, Transform; disabled
ccx_3 = CurveCurve(CurveA=scale_3.Geometry, CurveB=crv_37)  # -> Points, ParamsA, ParamsB; disabled

dist_2 = Distance(PointA=graft(end_2.End), PointB=cull_i_5)  # disabled
sort_6 = SortList(Keys=dist_2)  # -> Keys, ValuesA; disabled
item_16 = ListItem(List=sort_6.Keys, Index=0, Wrap=True)  # disabled
smaller_2 = SmallerThan(FirstNumber=item_16, SecondNumber=number_slider_14)  # -> SmallerThan, OrEqualTo; disabled
flatten = FlattenTree(Tree=item_16, Path="{0}")  # disabled
dispatch_14 = Dispatch(List=graft(pl_2), DispatchPattern=smaller_2.SmallerThan)  # -> ListA, ListB; disabled
panel_23 = Panel(flatten)  # disabled
flatten_2 = FlattenTree(Tree=ccx_3.Points, Path="{0}")  # disabled
lng = ListLength(List=scale_3.Geometry)  # disabled
lng_2 = ListLength(List=flatten_2)  # disabled

data_19 = Data(flatten(dispatch_14.ListA))  # disabled
deplane_8 = DeconstructPlane(Plane=data_19)  # -> Origin, XAxis, YAxis, ZAxis; disabled
amp_4 = Amplitude(Vector=deplane_8.YAxis, Amplitude=number_slider_15)  # disabled
move_5 = Move(Geometry=deplane_8.Origin, Motion=amp_4)  # -> Geometry, Transform; disabled
ln_10 = Line(StartPoint=deplane_8.Origin, EndPoint=move_5.Geometry)  # disabled
midpt_11 = CurveMiddle(Curve=ln_10)  # disabled
scale_4 = Scale(Geometry=ln_10, Center=midpt_11, Factor=number_slider_16)  # -> Geometry, Transform; disabled
ccx_4 = CurveCurve(CurveA=scale_4.Geometry, CurveB=crv_37)  # -> Points, ParamsA, ParamsB; disabled

data_20 = Data(flatten(dispatch_14.ListB))  # disabled
deplane_9 = DeconstructPlane(Plane=data_20)  # -> Origin, XAxis, YAxis, ZAxis; disabled
amp_5 = Amplitude(Vector=deplane_9.YAxis, Amplitude=number_slider_19)  # disabled
move_6 = Move(Geometry=deplane_9.Origin, Motion=amp_5)  # -> Geometry, Transform; disabled
ln_11 = Line(StartPoint=deplane_9.Origin, EndPoint=move_6.Geometry)  # disabled
midpt_12 = CurveMiddle(Curve=ln_11)  # disabled
scale_5 = Scale(Geometry=ln_11, Center=midpt_12, Factor=number_slider_20)  # -> Geometry, Transform; disabled
ccx_5 = CurveCurve(CurveA=scale_5.Geometry, CurveB=crv_37)  # -> Points, ParamsA, ParamsB; disabled

equals = Equality(FirstNumber=lng, SecondNumber=lng_2)  # -> Equality, Inequality; disabled
panel_24 = Panel(equals.Equality)  # disabled

# ----
# InsideCurve-大面
move2pt_3 = MoveToPoint(Geometry=data_18, PointA=flatten(deplane_7.Origin), PointB=flatten(ccx_3.Points))  # -> Moved, Vector, Transform; disabled

# ----
# InsideCurve-阳角
move2pt_4 = MoveToPoint(Geometry=data_19, PointA=deplane_8.Origin, PointB=ccx_4.Points)  # -> Moved, Vector, Transform; disabled

# ----
# InsideCurve-阴角
move2pt_5 = MoveToPoint(Geometry=data_20, PointA=deplane_9.Origin, PointB=ccx_5.Points)  # -> Moved, Vector, Transform; disabled

# ---- group: 阴阳角区分
cp = ClosestPoint(Point=pt_2, Cloud=item_2)  # -> ClosestPoint, CPIndex, Distance
item_17 = ListItem(List=item_2, Index=cp.CPIndex, Wrap=True)
crv_cp_2 = CurveClosestPoint(Point=item_17, Curve=offset)  # -> Point, Parameter, Distance
eval_2 = EvaluateCurve(Curve=offset, Parameter=crv_cp_2.Parameter)  # -> Point, Tangent, Angle

# ----
# 板槽埋Modeling
multiplication = Multiplication(A=s_x, B=addition)
multiplication_2 = Multiplication(A=s_y, B=addition_2)
recgrid = Rectangular(Plane=PlaneXY(0, 0, 0), SizeX=s_x, SizeY=s_y, ExtentX=addition, ExtentY=addition_2)  # -> Cells, Points
直径 = Text(filter_4)
division_2 = Division(A=multiplication, B=2)
division_3 = Division(A=multiplication_2, B=2)
vec = VectorXYZ(XComponent=expr("-x", division_2), YComponent=expr("-x", division_3), ZComponent=0)  # -> Vector, Length
move_7 = Move(Geometry=recgrid.Points, Motion=vec.Vector)  # -> Geometry, Transform
division_4 = Division(A=直径, B=2)
cyl = Cylinder(Base=move_7.Geometry, Radius=division_4, Length=expr("-x", expression))
X = UnitX(Factor=直径)
multiplication_3 = Multiplication(A=直径, B=6)
edges_2 = BrepEdges(Brep=cyl)  # -> Naked, Interior, NonManifold
item_18 = ListItem(List=edges_2.Naked, Index=0, Wrap=True)
max_2 = Maximum(A=multiplication_3, B=70)
move_8 = Move(Geometry=item_18, Motion=X)  # -> Geometry, Transform
multiplication_4 = Multiplication(A=max_2, B=2)
addition_4 = Addition(A=multiplication, B=multiplication_4)
addition_5 = Addition(A=multiplication_2, B=multiplication_4)
division_5 = Division(A=t, B=2)
expression_2 = Expression(x=addition_5, Expression="Ceiling(x/10)*10/2")
expression_3 = Expression(x=addition_4, Expression="Ceiling(x/10)*10/2")
round = Round(Number=division_5)  # -> Nearest, Floor, Ceiling
multiplication_5 = Multiplication(A=round.Ceiling, B=2)
dom = ConstructDomain(DomainStart=expr("-x", expression_2), DomainEnd=expression_2)
dom_2 = ConstructDomain(DomainStart=expr("-x", expression_3), DomainEnd=expression_3)
box = DomainBox(Base=PlaneXY(0, 0, 0), X=dom_2, Y=dom, Z=multiplication_5)
Z = UnitZ(Factor=expr("-x", multiplication_5))

multiplication_6 = Multiplication(A=直径, B=5)

Z_2 = UnitZ(Factor=multiplication_6)
extr = Extrude(Base=move_8.Geometry, Direction=Z_2)
cap = CapHoles(Brep=[extr, cyl])
merge_8 = Merge(Data1=cap, Data2=box)
flatten_3 = FlattenTree(Tree=merge_8, Path="{0}")
move_9 = Move(Geometry=flatten_3, Motion=Z)  # -> Geometry, Transform

brep_4 = Brep(move_9.Geometry)

# ----
# 槽埋+板埋合并
bbox_3 = BoundingBox(Content=brep_3, Plane=PlaneXY(0, 0, 0))  # -> Box, Box_2
debox_3 = DeconstructBox(Box=bbox_3.Box)  # -> Plane, X, Y, Z
area_9 = Area(Geometry=brep_3)  # -> Area, Centroid
dedomain_3 = DeconstructDomain(Domain=debox_3.Z)  # -> Start, End
pdecon_3 = Deconstruct(Point=area_9.Centroid)  # -> XComponent, YComponent, ZComponent
xy_19 = XYPlane(Origin=Point(0, 0, 0))
pt_5 = ConstructPoint(XCoordinate=pdecon_3.XComponent, YCoordinate=pdecon_3.YComponent, ZCoordinate=dedomain_3.End)
pl_origin_3 = PlaneOrigin(Base=xy_19, Origin=pt_5)
xy_20 = XYPlane(Origin=Point(0, 0, 0))
orient_3 = Orient(Geometry=brep_3, Source=pl_origin_3, Target=xy_20)  # -> Geometry, Transform
bbox_4 = BoundingBox(Content=orient_3.Geometry, Plane=PlaneXY(0, 0, 0))  # -> Box, Box_2
sdiff = SolidDifference(BrepsA=move_9.Geometry, BrepsB=bbox_4.Box)
sunion_3 = SolidUnion(Breps=[sdiff, orient_3.Geometry])  # -> flatten(Result)

edges_3 = BrepEdges(Brep=bbox_3.Box)  # -> Naked, Interior, NonManifold
item_19 = ListItem(List=edges_3.Interior, Index="5", Wrap=True)
item_20 = ListItem(List=edges_3.Interior, Index="4", Wrap=True)
clx_2 = CurveLine(Curve=item_20, Line=item_19)  # -> Points, Params, Count
Y_2 = UnitY(Factor=item_19)
rotate_4 = Rotate(Geometry=brep_3, Angle=1.570796327, Plane=clx_2.Points)  # -> Geometry, Transform
move_10 = Move(Geometry=rotate_4.Geometry, Motion=Y_2)  # -> Geometry, Transform
merge_9 = Merge(Data1=brep_3, Data2=move_10.Geometry)  # -> flatten(Result)
sunion_4 = SolidUnion(Breps=merge_9)
bbox_5 = BoundingBox(Content=sunion_4, Plane=PlaneXY(0, 0, 0))  # -> Box, Box_2
area_10 = Area(Geometry=sunion_4)  # -> Area, Centroid
debox_4 = DeconstructBox(Box=bbox_5.Box)  # -> Plane, X, Y, Z
pdecon_4 = Deconstruct(Point=area_10.Centroid)  # -> XComponent, YComponent, ZComponent
dedomain_4 = DeconstructDomain(Domain=debox_4.Z)  # -> Start, End
pt_6 = ConstructPoint(XCoordinate=pdecon_4.XComponent, YCoordinate=pdecon_4.YComponent, ZCoordinate=dedomain_4.End)
xy_21 = XYPlane(Origin=Point(0, 0, 0))
pl_origin_4 = PlaneOrigin(Base=xy_21, Origin=pt_6)
xy_22 = XYPlane(Origin=Point(0, 0, 0))
orient_4 = Orient(Geometry=sunion_4, Source=pl_origin_4, Target=xy_22)  # -> Geometry, Transform

entwine_3 = Entwine(Branch00=sunion_3, Branch01=orient_4.Geometry, FlattenInputs=True)

# ----
# 板埋Modeling
multiplication_7 = Multiplication(A=s_x, B=addition)
multiplication_8 = Multiplication(A=s_y, B=addition_2)
recgrid_2 = Rectangular(Plane=PlaneXY(0, 0, 0), SizeX=s_x, SizeY=s_y, ExtentX=addition, ExtentY=addition_2)  # -> Cells, Points
直径_2 = Text(filter_4)
division_6 = Division(A=multiplication_7, B=2)
division_7 = Division(A=multiplication_8, B=2)
vec_2 = VectorXYZ(XComponent=expr("-x", division_6), YComponent=expr("-x", division_7), ZComponent=0)  # -> Vector, Length
move_11 = Move(Geometry=recgrid_2.Points, Motion=vec_2.Vector)  # -> Geometry, Transform
division_8 = Division(A=直径_2, B=2)
cyl_2 = Cylinder(Base=move_11.Geometry, Radius=division_8, Length=expr("-x", expression))
X_2 = UnitX(Factor=直径_2)
multiplication_9 = Multiplication(A=直径_2, B=6)
edges_4 = BrepEdges(Brep=cyl_2)  # -> Naked, Interior, NonManifold
item_21 = ListItem(List=edges_4.Naked, Index=0, Wrap=True)
max_3 = Maximum(A=multiplication_9, B=70)
move_12 = Move(Geometry=item_21, Motion=X_2)  # -> Geometry, Transform
multiplication_10 = Multiplication(A=max_3, B=2)
addition_6 = Addition(A=multiplication_7, B=multiplication_10)
addition_7 = Addition(A=multiplication_8, B=multiplication_10)
division_9 = Division(A=t, B=2)
expression_4 = Expression(x=addition_7, Expression="Ceiling(x/10)*10/2")
expression_5 = Expression(x=addition_6, Expression="Ceiling(x/10)*10/2")
round_2 = Round(Number=division_9)  # -> Nearest, Floor, Ceiling
multiplication_11 = Multiplication(A=round_2.Ceiling, B=2)
dom_3 = ConstructDomain(DomainStart=expr("-x", expression_4), DomainEnd=expression_4)
dom_4 = ConstructDomain(DomainStart=expr("-x", expression_5), DomainEnd=expression_5)
box_2 = DomainBox(Base=PlaneXY(0, 0, 0), X=dom_4, Y=dom_3, Z=multiplication_11)
Z_3 = UnitZ(Factor=expr("-x", multiplication_11))
move_13 = Move(Geometry=box_2, Motion=Z_3)  # -> Geometry, Transform
Z_4 = UnitZ(Factor=expr("-x", multiplication_11))

multiplication_12 = Multiplication(A=直径_2, B=5)

Z_5 = UnitZ(Factor=multiplication_12)
extr_2 = Extrude(Base=move_12.Geometry, Direction=Z_5)
cap_2 = CapHoles(Brep=[extr_2, cyl_2])
merge_10 = Merge(Data1=cap_2, Data2=box_2)
flatten_4 = FlattenTree(Tree=merge_10, Path="{0}")
move_14 = Move(Geometry=flatten_4, Motion=Z_4)  # -> Geometry, Transform

box_3 = DomainBox(Base=PlaneXY(0, 0, 0), X=dom_4, Y=dom_4, Z=multiplication_11)
merge_11 = Merge(Data1=cap_2, Data2=box_3)
flatten_5 = FlattenTree(Tree=merge_11, Path="{0}")
move_15 = Move(Geometry=flatten_5, Motion=Z_4)  # -> Geometry, Transform
entwine_4 = Entwine(Branch00=move_14.Geometry, Branch01=move_15.Geometry, FlattenInputs=True)

# ---- group: 选单体
板埋or槽埋or板槽埋 = StreamFilter(Gate=list, Stream0=entwine_4, Stream1=entwine_2, Stream2=entwine_3)

# ----
# 三视图
# hidden lines of top+pers view
# move to center
# 如果无法完整的生成埋件的三视图，
# 建议选择埋件的3D在Rhino中将
# Top/Perspective/Front/Right 试图缩放至合适大小后重新运行
panel_25 = Panel("""Top
Perspective
Front
Right""")
m2d_rhino = Make2DRhinoView(Name=panel_25, Clip=True)
make2d = Make2D(Geometry=板埋or槽埋or板槽埋, View=m2d_rhino, TangentEdges=False, TangentSeams=False, AutoComputeMake2D=False)  # -> VisibleCurves, VisibleIndex, VisibleType, HiddenCurves, HiddenIndex, HiddenType
bang = ExplodeTree(Data=make2d.VisibleCurves)  # -> Branch0, Branch1, Branch2, Branch3, Branch4, Branch5, Branch6, Branch7
bang_2 = ExplodeTree(Data=make2d.VisibleCurves)  # -> Branch0, Branch1, Branch2, Branch3, Branch4, Branch5, Branch6, Branch7
divdist = DivideDistance(Curve=make2d.HiddenCurves, Distance=Slider(1, range=0..10))  # -> Points, Tangents, Parameters
graft_3 = GraftTree(Tree=make2d.HiddenCurves, IncludeEmptyLists=True, IncludeNullItems=True)
shatter = Shatter(Curve=graft_3, Parameters=divdist.Parameters)
dispatch_15 = Dispatch(List=shatter, DispatchPattern=[True, False])  # -> ListA, ListB
crv_38 = Curve(dispatch_15.ListA)
pshift_2 = ShiftPaths(Data=crv_38, Offset=-1)
pshift_3 = ShiftPaths(Data=pshift_2, Offset=-1)
bang_3 = ExplodeTree(Data=pshift_3)  # -> Branch0, Branch1, Branch2, Branch3, Branch4, Branch5, Branch6, Branch7
bang_4 = ExplodeTree(Data=pshift_3)  # -> Branch0, Branch1, Branch2, Branch3, Branch4, Branch5, Branch6, Branch7
entwine_5 = Entwine(Branch00=bang_4.Branch4, Branch01=bang_2.Branch4, FlattenInputs=True)  # -> flatten(Result)
entwine_6 = Entwine(Branch00=bang_4.Branch5, Branch01=bang_2.Branch5, FlattenInputs=True)  # -> flatten(Result)
entwine_7 = Entwine(Branch00=bang_3.Branch0, Branch01=bang.Branch0, FlattenInputs=True)  # -> flatten(Result)
entwine_8 = Entwine(Branch00=bang_3.Branch1, Branch01=bang.Branch1, FlattenInputs=True)  # -> flatten(Result)
entwine_9 = Entwine(Branch00=entwine_7, Branch01=entwine_8, Branch02=bang.Branch2, Branch03=bang.Branch3, FlattenInputs=True)
entwine_10 = Entwine(Branch00=entwine_5, Branch01=entwine_6, Branch02=bang_2.Branch6, Branch03=bang_2.Branch7, FlattenInputs=True)
group = Group(Objects=entwine_9)
group_2 = Group(Objects=entwine_10)
entwine_11 = Entwine(Branch00=group, Branch01=group_2, FlattenInputs=True)
pshift_4 = ShiftPaths(Data=entwine_11, Offset=-1)
pshift_5 = ShiftPaths(Data=entwine_11, Offset=-1)
number_slider_21 = Slider(2, range=0..10)
# Rhino 文件中导入的块名
boxprop = BoxProperties(Box=pshift_4)  # -> Center, Diagonal, Area, Volume, Degeneracy
pt_7 = Point(Point(957.9296072, 367.7685097, 0))
pt_8 = Point("0,0,0")
recgrid_3 = Rectangular(
    Plane=pt_7,
    SizeX=Slider(12, range=1..20, expression="X*50"),
    SizeY=Slider(10, range=1..20, expression="X*50"),
    ExtentX=number_slider_21,
    ExtentY=number_slider_21)  # -> Cells, Points
vec2pt = Vector2Pt(PointA=boxprop.Center, PointB=pt_8, Unitize=False)  # -> Vector, Length
flatten_6 = FlattenTree(Tree=recgrid_3.Points, Path="{0}")
move_16 = Move(Geometry=pshift_5, Motion=vec2pt.Vector)  # -> flatten(Geometry), Transform
orient_5 = Orient(Geometry=flatten(move_16.Geometry), Source=PlaneXY(0, 0, 0), Target=flatten_6)  # -> Geometry, Transform
cull_i_6 = CullIndex(List=orient_5.Geometry, Indices="-1", Wrap=True)
split = SplitList(List=cull_i_6, Index="4")  # -> ListA, ListB
data_21 = Data(split.ListA)
data_22 = Data(split.ListB)
entwine_12 = Entwine(Branch00=data_21, Branch01=data_22, FlattenInputs=True)
geo_6 = Geometry(entwine_12)

# ---- group: 单体定Top/Side
item_22 = ListItem(List=geo_6, Index=2, Wrap=True)
item_23 = ListItem(List=geo_6, Index=Slider(0, range=0..10), Wrap=True)
cluster = Cluster(G=item_23)
cluster_2 = Cluster(G=item_22)

# ---- group: 单体定Top/Side / Top/Side
filter_12 = StreamFilter(Gate=list_2, Stream0=cluster, Stream1=cluster_2)

# ---- group: 单体定Top/Side / Monomer + Top/Side
filter_13 = StreamFilter(Gate=list, Stream0=filter_12, Stream1=filter_12, Stream2=filter_12)  # -> flatten(Stream)

# ---- group: Block
# 自定义块所在图层
# 自定义块所在图层颜色
# 自定义块名称
panel_26 = Panel("Embeded::Embeded")
layer_2 = DefineLayer(Name=panel_26, Color=ColourSwatch(SwatchColor=RGB(255, 0, 0)))
attributes = DefineObjectAttributes(Layer=layer_2)
block = DefineBlock(Geometry=filter_12, Attributes=attributes, BlockName="Steel Plate", BasePlane=PlaneXY(0, 0, 0))

# ---- group: 正常+阳角+阴角区分
cull_i_7 = CullIndex(List=item_2, Indices=cp.CPIndex, Wrap=True)
crv_39 = Curve(offset)
crv_40 = Curve(flip.Curve)
explode_4 = Explode(Curve=crv_39, Recursive=True)  # -> Segments, Vertices
explode_5 = Explode(Curve=crv_40, Recursive=True)  # -> Segments, Vertices

# ---- group: 阴角定位-细化
item_24 = ListItem(List=item, Index=cp.CPIndex, Wrap=True)

# ----
# 求主体曲线转折点
clscrv = CloseCurve(Curve=crv_11, CloseType=0, Bulge=0.5, Tolerance=0)  # -> Closed, R
crv_41 = Curve(crv_9)
disc_5 = Discontinuity(Curve=graft(crv_41), Level=1)  # -> Points, Parameters
crv_cp_3 = CurveClosestPoint(Point=disc_5.Points, Curve=graft(crv_41))  # -> Point, Parameter, Distance
eval_3 = EvaluateCurve(Curve=graft(crv_41), Parameter=crv_cp_3.Parameter)  # -> flatten(Point), Tangent, flatten(Angle)
deg_2 = Degrees(Radians=eval_3.Angle)
offset_13 = OffsetCurve(Curve=clscrv.Closed, Distance=expr("-X", Slider(300, range=0..1000)), Corners=1)
panel_27 = Panel(deg_2)
larger_4 = LargerThan(FirstNumber=deg_2, SecondNumber=Slider(60, range=0..100))  # -> LargerThan, OrEqualTo
disc_6 = Discontinuity(Curve=offset_13, Level=1)  # -> flatten(Points), Parameters
dispatch_16 = Dispatch(List=eval_3.Point, DispatchPattern=larger_4.LargerThan)  # -> ListA, ListB

# ----
# 第一层
# 
# Angular Curves(architecture line)
number_slider_22 = Slider(84, range=0..1000)
crv_42 = Curve(project_7.Geometry)
crv_43 = Curve(clscrv.Closed)
offset_14 = OffsetCurve(Curve=crv_43, Distance=expr("-x", number_slider_22), Corners=1)  # -> flatten(Curve)
disc_7 = Discontinuity(Curve=crv_42, Level=1)  # -> Points, Parameters
pull_9 = PullPoint(Point=disc_7.Points, Geometry=offset_14, ClosestOnly=True)  # -> ClosestPoint, Distance
disc_8 = Discontinuity(Curve=offset_14, Level=1)  # -> Points, Parameters
pull_10 = PullPoint(Point=flatten(pull_9.ClosestPoint), Geometry=flatten(disc_8.Points), ClosestOnly=True)  # -> ClosestPoint, Distance
check_same_points = CheckSamePoints(archPoint=flatten(pull_9.ClosestPoint), crvPoint=flatten(pull_10.ClosestPoint))  # -> out, specialPt; inputs archPoint: list of Point3d, crvPoint: list of Point3d; same code as testpoint
cull_i_8 = CullIndex(List=flatten(disc_7.Points), Indices=check_same_points.specialPt, Wrap=True)
end_4 = EndPoints(Curve=crv_42)  # -> Start, End
merge_12 = Merge(Data1=end_4.Start, Data2=end_4.End, Data3=cull_i_8)
flatten_7 = FlattenTree(Tree=disc_7.Points, Path="{0}")
check_same_points_2 = CheckSamePoints(archPoint=flatten(flatten_7), crvPoint=flatten(merge_12))  # -> out, specialPt; inputs archPoint: list of Point3d, crvPoint: list of Point3d; same code as testpoint
cull_i_9 = CullIndex(List=flatten(flatten_7), Indices=check_same_points_2.specialPt, Wrap=True)
pull_11 = PullPoint(Point=cull_i_9, Geometry=offset_14, ClosestOnly=True)  # -> ClosestPoint, Distance
ln_12 = Line(StartPoint=cull_i_9, EndPoint=pull_11.ClosestPoint)
rotate_5 = Rotate(Geometry=ln_12, Angle="Pi", Plane=cull_i_9)  # -> Geometry, Transform
rotate_6 = Rotate(Geometry=ln_12, Angle=1.570796327, Plane=cull_i_9)  # -> Geometry, Transform

# ----
# 第一层
# 
# Angular Curves(architecture line)
crv_44 = Curve(crv_10)
crv_45 = Curve(clscrv.Closed)
offset_15 = OffsetCurve(Curve=crv_45, Distance=expr("-x", Slider(84, range=0..1000)), Corners=1)  # -> flatten(Curve)
disc_9 = Discontinuity(Curve=crv_44, Level=1)  # -> Points, Parameters
pull_12 = PullPoint(Point=disc_9.Points, Geometry=offset_15, ClosestOnly=True)  # -> ClosestPoint, Distance
disc_10 = Discontinuity(Curve=offset_15, Level=1)  # -> Points, Parameters
pull_13 = PullPoint(Point=flatten(pull_12.ClosestPoint), Geometry=flatten(disc_10.Points), ClosestOnly=True)  # -> ClosestPoint, Distance
check_same_points_3 = CheckSamePoints(archPoint=flatten(pull_12.ClosestPoint), crvPoint=flatten(pull_13.ClosestPoint))  # -> out, specialPt; inputs archPoint: list of Point3d, crvPoint: list of Point3d; same code as testpoint
cull_i_10 = CullIndex(List=flatten(disc_9.Points), Indices=check_same_points_3.specialPt, Wrap=True)
end_5 = EndPoints(Curve=crv_44)  # -> Start, End
merge_13 = Merge(Data1=end_5.Start, Data2=end_5.End, Data3=cull_i_10)
flatten_8 = FlattenTree(Tree=disc_9.Points, Path="{0}")
check_same_points_4 = CheckSamePoints(archPoint=flatten(flatten_8), crvPoint=flatten(merge_13))  # -> out, specialPt; inputs archPoint: list of Point3d, crvPoint: list of Point3d; same code as testpoint
cull_i_11 = CullIndex(List=flatten(flatten_8), Indices=check_same_points_4.specialPt, Wrap=True)
pull_14 = PullPoint(Point=cull_i_11, Geometry=offset_15, ClosestOnly=True)  # -> ClosestPoint, Distance
ln_13 = Line(StartPoint=cull_i_11, EndPoint=pull_14.ClosestPoint)
rotate_7 = Rotate(Geometry=ln_13, Angle="Pi", Plane=cull_i_11)  # -> Geometry, Transform
rotate_8 = Rotate(Geometry=rotate_7.Geometry, Angle=-1.570796327, Plane=cull_i_11)  # -> Geometry, Transform

# ----
# 转角点
data_23 = Data(dispatch_16.ListA)

pull_15 = PullPoint(Point=data_23, Geometry=flatten(offset_13), ClosestOnly=True)  # -> ClosestPoint, Distance
testpoint_2 = TestPoint(archPoint=pull_15.ClosestPoint, crvPoint=disc_6.Points)  # -> out, specialPt; inputs archPoint: list of Point3d, crvPoint: list of Point3d; same code as testpoint

# ----
# 找阴阳角所在corners
pull_16 = PullPoint(Point=flatten(pln_10), Geometry=crv_41, ClosestOnly=True)  # -> ClosestPoint, Distance
pull_17 = PullPoint(Point=pull_16.ClosestPoint, Geometry=data_23, ClosestOnly=True)  # -> ClosestPoint, Distance
flatten_9 = FlattenTree(Tree=data_10, Path="{0}")
sort_7 = SortList(Keys=pull_17.Distance, ValuesA=flatten_9)  # -> Keys, ValuesA
panel_28 = Panel(sort_7.Keys)
smaller_3 = SmallerThan(FirstNumber=sort_7.Keys, SecondNumber=Slider(100, range=0..100))  # -> SmallerThan, OrEqualTo
dispatch_17 = Dispatch(List=sort_7.ValuesA, DispatchPattern=smaller_3.SmallerThan)  # -> ListA, ListB
data_24 = Data(dispatch_17.ListA)
deblock_6 = DeconstructBlock(Block=data_24)  # -> Name, Plane, Geometry
deplane_10 = DeconstructPlane(Plane=deblock_6.Plane)  # -> Origin, XAxis, YAxis, ZAxis
pt_9 = Point(data_23)
pull_18 = PullPoint(Point=deplane_10.Origin, Geometry=pt_9, ClosestOnly=True)  # -> ClosestPoint, Distance
cir = Circle(Plane=pull_18.ClosestPoint, Radius=Slider(300, range=0..1000))
crv_46 = Curve(crv_41)
amp_6 = Amplitude(Vector=deplane_10.YAxis, Amplitude=Slider(200, range=0..1000))
ccx_6 = CurveCurve(CurveA=cir, CurveB=crv_46)  # -> Points, ParamsA, ParamsB
move_17 = Move(Geometry=pull_18.ClosestPoint, Motion=amp_6)  # -> Geometry, Transform
item_25 = ListItem(List=ccx_6.Points, Index=0, Wrap=True)
clean = CleanTree(RemoveNulls=True, RemoveInvalid=True, RemoveEmpty=Toggle(True), Tree=item_25)
ln_14 = Line(StartPoint=pull_18.ClosestPoint, EndPoint=clean)
ln_15 = Line(StartPoint=pull_18.ClosestPoint, EndPoint=move_17.Geometry)
angle = Angle(VectorA=ln_15, VectorB=ln_14)  # -> Angle, Reflex
deg_3 = Degrees(Radians=angle.Angle)
flatten_10 = FlattenTree(Tree=deg_3, Path="{0}")
panel_29 = Panel(flatten_10)
c_script = CSharpScript(angle=flatten_10, minus=Slider(80, range=0..100))  # -> out, results; inputs angle: list of Double, minus: Double
# ---------- c_script: C# ----------
    List<double> MyAngle = new List<double>();
    for(int i = 0; i < angle.Count; i++){
      if (angle[i] > minus){
        angleEach = angle[i] - 90;
        Print("!!!!!!!!");
        MyAngle.Add(angleEach);
      }
      else{
        angleEach = angle[i];
        Print("00000");
        MyAngle.Add(angleEach);
      }

    }

    results = MyAngle;
# ---------- c_script: C# additional code ----------
  double angleEach = 0;
# ---------- end c_script ----------
larger_5 = LargerThan(FirstNumber=c_script.results, SecondNumber=Slider(30, range=0..100))  # -> LargerThan, OrEqualTo
panel_30 = Panel(c_script.results)
dispatch_18 = Dispatch(List=flatten(data_24), DispatchPattern=flatten(larger_5.LargerThan))  # -> ListA, ListB
data_25 = Data(dispatch_18.ListA)

# ----
# SmoothCurve-阴角&阳角
# 阳角
item_26 = ListItem(List=data_23, Index=testpoint_2.specialPt, Wrap=True)

# ----
# 阴角
cull_i_12 = CullIndex(List=data_23, Indices=testpoint_2.specialPt, Wrap=True)

# ----
# remove duplicate block and reconstruct plane
deblock_7 = DeconstructBlock(Block=data_25)  # -> Name, Plane, Geometry
deplane_11 = DeconstructPlane(Plane=flatten(deblock_7.Plane))  # -> Origin, XAxis, YAxis, ZAxis

# ----
# 第一层
# 
# Block(location point) + Smooth Curves(architecture line)
# For Correct Plane
pln_13 = Plane(flatten(pln_10))
deplane_12 = DeconstructPlane(Plane=pln_13)  # -> Origin, XAxis, YAxis, ZAxis
testpoint_3 = TestPoint(archPoint=deplane_12.Origin, crvPoint=deplane_11.Origin)  # -> out, specialPt; inputs archPoint: list of Point3d, crvPoint: list of Point3d; same code as testpoint
cull_i_13 = CullIndex(List=pln_13, Indices=testpoint_3.specialPt, Wrap=True)
pln_14 = Plane(deblock_7.Plane)
dist_3 = Distance(PointA=graft(deplane_11.Origin), PointB=item_26)
sort_8 = SortList(Keys=dist_3)  # -> Keys, ValuesA
item_27 = ListItem(List=sort_8.Keys, Index=0, Wrap=True)
flatten_11 = FlattenTree(Tree=item_27, Path="{0}")
smaller_4 = SmallerThan(FirstNumber=item_27, SecondNumber=Slider(100, range=0..300))  # -> SmallerThan, OrEqualTo
panel_31 = Panel(flatten_11)
dispatch_19 = Dispatch(List=graft(pln_14), DispatchPattern=smaller_4.SmallerThan)  # -> ListA, ListB

pln_15 = Plane(cull_i_13)

data_26 = Data(flatten(dispatch_19.ListA))
deplane_13 = DeconstructPlane(Plane=data_26)  # -> Origin, XAxis, YAxis, ZAxis
amp_7 = Amplitude(Vector=deplane_13.YAxis, Amplitude=Slider(300, range=0..1000))
move_18 = Move(Geometry=deplane_13.Origin, Motion=amp_7)  # -> Geometry, Transform
ln_16 = Line(StartPoint=deplane_13.Origin, EndPoint=move_18.Geometry)
midpt_13 = CurveMiddle(Curve=ln_16)
scale_6 = Scale(Geometry=ln_16, Center=midpt_13, Factor=Slider(1.5, range=0..10))  # -> Geometry, Transform
ccx_7 = CurveCurve(CurveA=graft(scale_6.Geometry), CurveB=crv_20)  # -> flatten(Points), ParamsA, ParamsB

data_27 = Data(flatten(dispatch_19.ListB))
deplane_14 = DeconstructPlane(Plane=data_27)  # -> Origin, XAxis, YAxis, ZAxis
amp_8 = Amplitude(Vector=deplane_14.YAxis, Amplitude=Slider(300, range=0..1000))
move_19 = Move(Geometry=deplane_14.Origin, Motion=amp_8)  # -> Geometry, Transform
ln_17 = Line(StartPoint=deplane_14.Origin, EndPoint=move_19.Geometry)
midpt_14 = CurveMiddle(Curve=ln_17)
scale_7 = Scale(Geometry=ln_17, Center=midpt_14, Factor=Slider(1.5, range=0..10))  # -> Geometry, Transform
ccx_8 = CurveCurve(CurveA=graft(scale_7.Geometry), CurveB=crv_20)  # -> flatten(Points), ParamsA, ParamsB

data_28 = Data(flatten(pln_15))
deplane_15 = DeconstructPlane(Plane=data_28)  # -> Origin, XAxis, YAxis, ZAxis
amp_9 = Amplitude(Vector=deplane_15.YAxis, Amplitude=Slider(300, range=0..1000))
move_20 = Move(Geometry=deplane_15.Origin, Motion=amp_9)  # -> Geometry, Transform
ln_18 = Line(StartPoint=deplane_15.Origin, EndPoint=move_20.Geometry)
midpt_15 = CurveMiddle(Curve=ln_18)
scale_8 = Scale(Geometry=ln_18, Center=midpt_15, Factor=Slider(4.7, range=0..10))  # -> Geometry, Transform
ccx_9 = CurveCurve(CurveA=graft(scale_8.Geometry), CurveB=crv_20)  # -> flatten(Points), ParamsA, ParamsB

# ----
# SmoothCurve-正常
move2pt_6 = MoveToPoint(Geometry=data_28, PointA=deplane_15.Origin, PointB=ccx_9.Points)  # -> Moved, Vector, Transform

# ----
# SmoothCurve-阳角
move2pt_7 = MoveToPoint(Geometry=data_26, PointA=deplane_13.Origin, PointB=ccx_7.Points)  # -> Moved, Vector, Transform

# ----
# SmoothCurve-阴角
move2pt_8 = MoveToPoint(Geometry=data_27, PointA=deplane_14.Origin, PointB=ccx_8.Points)  # -> Moved, Vector, Transform

# ----
# Angular Curve - All
pl_4 = ConstructPlane(Origin=cull_i_11, XAxis=rotate_7.Geometry, YAxis=rotate_8.Geometry)

# ----
# Curve for this project only - All
pl_5 = ConstructPlane(Origin=cull_i_9, XAxis=rotate_5.Geometry, YAxis=rotate_6.Geometry)

# ----
# 求主体曲线转折点
clscrv_2 = CloseCurve(Curve=crv_11, CloseType=0, Bulge=0.5, Tolerance=0)  # -> Closed, R
crv_47 = Curve(crv_9)
disc_11 = Discontinuity(Curve=graft(crv_47), Level=1)  # -> Points, Parameters
crv_cp_4 = CurveClosestPoint(Point=disc_11.Points, Curve=graft(crv_47))  # -> Point, Parameter, Distance
eval_4 = EvaluateCurve(Curve=graft(crv_47), Parameter=crv_cp_4.Parameter)  # -> flatten(Point), Tangent, flatten(Angle)
deg_4 = Degrees(Radians=eval_4.Angle)
offset_16 = OffsetCurve(Curve=clscrv_2.Closed, Distance=expr("-X", Slider(300, range=0..1000)), Corners=1)
panel_32 = Panel(deg_4)
larger_6 = LargerThan(FirstNumber=deg_4, SecondNumber=Slider(60, range=0..100))  # -> LargerThan, OrEqualTo
disc_12 = Discontinuity(Curve=offset_16, Level=1)  # -> flatten(Points), Parameters
dispatch_20 = Dispatch(List=eval_4.Point, DispatchPattern=larger_6.LargerThan)  # -> ListA, ListB

# ----
# 转角点
data_29 = Data(dispatch_20.ListA)

pull_19 = PullPoint(Point=data_29, Geometry=flatten(offset_16), ClosestOnly=True)  # -> ClosestPoint, Distance
testpoint_4 = TestPoint(archPoint=pull_19.ClosestPoint, crvPoint=disc_12.Points)  # -> out, specialPt; inputs archPoint: list of Point3d, crvPoint: list of Point3d; same code as testpoint

# ----
# 找阴阳角所在corners
pull_20 = PullPoint(Point=flatten(pln_11), Geometry=crv_47, ClosestOnly=True)  # -> ClosestPoint, Distance
pull_21 = PullPoint(Point=pull_20.ClosestPoint, Geometry=data_29, ClosestOnly=True)  # -> ClosestPoint, Distance
flatten_12 = FlattenTree(Tree=data_11, Path="{0}")
sort_9 = SortList(Keys=pull_21.Distance, ValuesA=flatten_12)  # -> Keys, ValuesA
panel_33 = Panel(sort_9.Keys)
smaller_5 = SmallerThan(FirstNumber=sort_9.Keys, SecondNumber=Slider(100, range=0..100))  # -> SmallerThan, OrEqualTo
dispatch_21 = Dispatch(List=sort_9.ValuesA, DispatchPattern=smaller_5.SmallerThan)  # -> ListA, ListB
data_30 = Data(dispatch_21.ListA)
deblock_8 = DeconstructBlock(Block=data_30)  # -> Name, Plane, Geometry
deplane_16 = DeconstructPlane(Plane=deblock_8.Plane)  # -> Origin, XAxis, YAxis, ZAxis
pt_10 = Point(data_29)
pull_22 = PullPoint(Point=deplane_16.Origin, Geometry=pt_10, ClosestOnly=True)  # -> ClosestPoint, Distance
cir_2 = Circle(Plane=pull_22.ClosestPoint, Radius=Slider(300, range=0..1000))
crv_48 = Curve(crv_47)
amp_10 = Amplitude(Vector=deplane_16.YAxis, Amplitude=Slider(200, range=0..1000))
ccx_10 = CurveCurve(CurveA=cir_2, CurveB=crv_48)  # -> Points, ParamsA, ParamsB
move_21 = Move(Geometry=pull_22.ClosestPoint, Motion=amp_10)  # -> Geometry, Transform
item_28 = ListItem(List=ccx_10.Points, Index=0, Wrap=True)
clean_2 = CleanTree(RemoveNulls=True, RemoveInvalid=True, RemoveEmpty=Toggle(True), Tree=item_28)
ln_19 = Line(StartPoint=pull_22.ClosestPoint, EndPoint=clean_2)
ln_20 = Line(StartPoint=pull_22.ClosestPoint, EndPoint=move_21.Geometry)
angle_2 = Angle(VectorA=ln_20, VectorB=ln_19)  # -> Angle, Reflex
deg_5 = Degrees(Radians=angle_2.Angle)
flatten_13 = FlattenTree(Tree=deg_5, Path="{0}")
panel_34 = Panel(flatten_13)
c_script_2 = CSharpScript(angle=flatten_13, minus=Slider(80, range=0..100))  # -> out, results; inputs angle: list of Double, minus: Double; same code as c_script
larger_7 = LargerThan(FirstNumber=c_script_2.results, SecondNumber=Slider(30, range=0..100))  # -> LargerThan, OrEqualTo
panel_35 = Panel(c_script_2.results)
dispatch_22 = Dispatch(List=flatten(data_30), DispatchPattern=flatten(larger_7.LargerThan))  # -> ListA, ListB
data_31 = Data(dispatch_22.ListA)

# ----
# SmoothCurve-阴角&阳角
# 阳角
item_29 = ListItem(List=data_29, Index=testpoint_4.specialPt, Wrap=True)

# ----
# 阴角
cull_i_14 = CullIndex(List=data_29, Indices=testpoint_4.specialPt, Wrap=True)

# ----
# remove duplicate block and reconstruct plane
deblock_9 = DeconstructBlock(Block=data_31)  # -> Name, Plane, Geometry
deplane_17 = DeconstructPlane(Plane=flatten(deblock_9.Plane))  # -> Origin, XAxis, YAxis, ZAxis

# ----
# 第一层
# 
# Block(location point) + Smooth Curves(architecture line)
# 
# For Wrong Plane
pln_16 = Plane(flatten(pln_11))
deplane_18 = DeconstructPlane(Plane=pln_16)  # -> Origin, XAxis, YAxis, ZAxis
testpoint_5 = TestPoint(archPoint=deplane_18.Origin, crvPoint=deplane_17.Origin)  # -> out, specialPt; inputs archPoint: list of Point3d, crvPoint: list of Point3d; same code as testpoint
cull_i_15 = CullIndex(List=pln_16, Indices=testpoint_5.specialPt, Wrap=True)
pln_17 = Plane(deblock_9.Plane)
dist_4 = Distance(PointA=graft(deplane_17.Origin), PointB=item_29)
sort_10 = SortList(Keys=dist_4)  # -> Keys, ValuesA
item_30 = ListItem(List=sort_10.Keys, Index=0, Wrap=True)
flatten_14 = FlattenTree(Tree=item_30, Path="{0}")
smaller_6 = SmallerThan(FirstNumber=item_30, SecondNumber=Slider(100, range=0..300))  # -> SmallerThan, OrEqualTo
panel_36 = Panel(flatten_14)
dispatch_23 = Dispatch(List=graft(pln_17), DispatchPattern=smaller_6.SmallerThan)  # -> ListA, ListB

pln_18 = Plane(cull_i_15)

data_32 = Data(flatten(dispatch_23.ListA))
deplane_19 = DeconstructPlane(Plane=data_32)  # -> Origin, XAxis, YAxis, ZAxis
amp_11 = Amplitude(Vector=deplane_19.YAxis, Amplitude=Slider(300, range=0..1000))
move_22 = Move(Geometry=deplane_19.Origin, Motion=amp_11)  # -> Geometry, Transform
ln_21 = Line(StartPoint=deplane_19.Origin, EndPoint=move_22.Geometry)
midpt_16 = CurveMiddle(Curve=ln_21)
scale_9 = Scale(Geometry=ln_21, Center=midpt_16, Factor=Slider(1.5, range=0..10))  # -> Geometry, Transform
ccx_11 = CurveCurve(CurveA=graft(scale_9.Geometry), CurveB=crv_21)  # -> flatten(Points), ParamsA, ParamsB

data_33 = Data(flatten(dispatch_23.ListB))
deplane_20 = DeconstructPlane(Plane=data_33)  # -> Origin, XAxis, YAxis, ZAxis
amp_12 = Amplitude(Vector=deplane_20.YAxis, Amplitude=Slider(300, range=0..1000))
move_23 = Move(Geometry=deplane_20.Origin, Motion=amp_12)  # -> Geometry, Transform
ln_22 = Line(StartPoint=deplane_20.Origin, EndPoint=move_23.Geometry)
midpt_17 = CurveMiddle(Curve=ln_22)
scale_10 = Scale(Geometry=ln_22, Center=midpt_17, Factor=Slider(1.5, range=0..10))  # -> Geometry, Transform
ccx_12 = CurveCurve(CurveA=graft(scale_10.Geometry), CurveB=crv_21)  # -> flatten(Points), ParamsA, ParamsB

data_34 = Data(flatten(pln_18))
deplane_21 = DeconstructPlane(Plane=data_34)  # -> Origin, XAxis, YAxis, ZAxis
amp_13 = Amplitude(Vector=deplane_21.YAxis, Amplitude=Slider(300, range=0..1000))
move_24 = Move(Geometry=deplane_21.Origin, Motion=amp_13)  # -> Geometry, Transform
ln_23 = Line(StartPoint=deplane_21.Origin, EndPoint=move_24.Geometry)
midpt_18 = CurveMiddle(Curve=ln_23)
scale_11 = Scale(Geometry=ln_23, Center=midpt_18, Factor=Slider(4.7, range=0..10))  # -> Geometry, Transform
ccx_13 = CurveCurve(CurveA=graft(scale_11.Geometry), CurveB=crv_21)  # -> flatten(Points), ParamsA, ParamsB

move2pt_9 = MoveToPoint(Geometry=data_34, PointA=deplane_21.Origin, PointB=ccx_13.Points)  # -> Moved, Vector, Transform
move2pt_10 = MoveToPoint(Geometry=data_32, PointA=deplane_19.Origin, PointB=ccx_11.Points)  # -> Moved, Vector, Transform
move2pt_11 = MoveToPoint(Geometry=data_33, PointA=deplane_20.Origin, PointB=ccx_12.Points)  # -> Moved, Vector, Transform
xy_23 = XYPlane(Origin=move2pt_9.Moved)
xy_24 = XYPlane(Origin=move2pt_10.Moved)
xy_25 = XYPlane(Origin=move2pt_11.Moved)
rotate_9 = Rotate(Geometry=move2pt_9.Moved, Angle="Pi", Plane=xy_23)  # -> Geometry, Transform
rotate_10 = Rotate(Geometry=move2pt_10.Moved, Angle="Pi", Plane=xy_24)  # -> Geometry, Transform
rotate_11 = Rotate(Geometry=move2pt_11.Moved, Angle="Pi", Plane=xy_25)  # -> Geometry, Transform

# ----
# SmoothCurve-正常
toggle_4 = BooleanToggle(True)
filter_14 = StreamFilter(Gate=toggle_4, Stream0=move2pt_9.Moved, Stream1=rotate_9.Geometry)

# ----
# SmoothCurve-阳角
toggle_5 = BooleanToggle(True)
filter_15 = StreamFilter(Gate=toggle_5, Stream0=move2pt_10.Moved, Stream1=rotate_10.Geometry)

# ----
# SmoothCurve-阴角
toggle_6 = BooleanToggle(True)
filter_16 = StreamFilter(Gate=toggle_6, Stream0=move2pt_11.Moved, Stream1=rotate_11.Geometry)

# ----
# 第一层
# 
# Curves(location point)+ Smooth Curves(architecture line)
# 第二层-大面定位
area_11 = Area(Geometry=geo_5)  # -> Area, Centroid
pull_23 = PullPoint(Point=area_11.Centroid, Geometry=crv_19, ClosestOnly=True)  # -> ClosestPoint, Distance
dist_5 = Distance(PointA=pull_23.ClosestPoint, PointB=data_23)
sort_11 = SortList(Keys=dist_5)  # -> Keys, ValuesA
panel_37 = Panel(sort_11.Keys)
smaller_7 = SmallerThan(FirstNumber=dist_5, SecondNumber=Slider(200, range=0..1000))  # -> SmallerThan, OrEqualTo
dispatch_24 = Dispatch(List=geo_5, DispatchPattern=smaller_7.SmallerThan)  # -> ListA, ListB
data_35 = Data(dispatch_24.ListB)
explode_6 = Explode(Curve=data_35, Recursive=True)  # -> Segments, Vertices
len_5 = Length(Curve=explode_6.Segments)
sort_12 = SortList(Keys=reverse(len_5), ValuesA=explode_6.Segments)  # -> Keys, ValuesA
item_31 = ListItem(List=sort_12.ValuesA, Index=0, Wrap=True)  # -> flatten(Item)
area_12 = Area(Geometry=data_35)  # -> Area, Centroid
midpt_19 = CurveMiddle(Curve=item_31)
move2pt_12 = MoveToPoint(Geometry=item_31, PointA=midpt_19, PointB=area_12.Centroid)  # -> Moved, Vector, Transform
end_6 = EndPoints(Curve=move2pt_12.Moved)  # -> Start, End
pull_24 = PullPoint(Point=end_6.Start, Geometry=crv_19, ClosestOnly=True)  # -> ClosestPoint, Distance
neg_4 = Negative(Value="1.5 * Pi")
crv_cp_5 = CurveClosestPoint(Point=graft(pull_24.ClosestPoint), Curve=crv_19)  # -> Point, Parameter, Distance
filter_17 = StreamFilter(Gate=Toggle(True), Stream0="1.5 * Pi", Stream1=neg_4)
eval_5 = EvaluateCurve(Curve=crv_19, Parameter=crv_cp_5.Parameter)  # -> Point, Tangent, Angle
pull_25 = PullPoint(Point=eval_5.Point, Geometry=pull_24.ClosestPoint, ClosestOnly=True)  # -> ClosestPoint, Distance
sort_13 = SortList(Keys=pull_25.Distance, ValuesA=eval_5.Point)  # -> Keys, ValuesA
sort_14 = SortList(Keys=pull_25.Distance, ValuesA=eval_5.Tangent)  # -> Keys, ValuesA
item_32 = ListItem(List=sort_14.ValuesA, Index="0", Wrap=True)
item_33 = ListItem(List=sort_13.ValuesA, Index="0", Wrap=True)
amp_14 = Amplitude(Vector=item_32, Amplitude=Slider(100, range=0..100))
move_25 = Move(Geometry=item_33, Motion=amp_14)  # -> Geometry, Transform
xy_26 = XYPlane(Origin=item_33)
rotate_12 = Rotate(Geometry=move_25.Geometry, Angle="1 * Pi", Plane=xy_26)  # -> Geometry, Transform
ln_24 = Line(StartPoint=item_33, EndPoint=rotate_12.Geometry)
crv_49 = Curve(crv_9)
rotate_13 = Rotate(Geometry=ln_24, Angle=filter_17, Plane=xy_26)  # -> Geometry, Transform

# ----
# 第二层-阴阳角
data_36 = Data(dispatch_24.ListA)
explode_7 = Explode(Curve=data_36, Recursive=True)  # -> Segments, Vertices
len_6 = Length(Curve=explode_7.Segments)
sort_15 = SortList(Keys=reverse(len_6), ValuesA=explode_7.Segments)  # -> Keys, ValuesA
item_34 = ListItem(List=sort_15.ValuesA, Index=0, Wrap=True)  # -> flatten(Item)
area_13 = Area(Geometry=data_36)  # -> Area, Centroid
midpt_20 = CurveMiddle(Curve=item_34)
move2pt_13 = MoveToPoint(Geometry=item_34, PointA=midpt_20, PointB=area_13.Centroid)  # -> Moved, Vector, Transform
end_7 = EndPoints(Curve=move2pt_13.Moved)  # -> Start, End
ln_25 = Line(StartPoint=end_7.Start, EndPoint=end_7.End)
neg_5 = Negative(Value="0.5 * Pi")
filter_18 = StreamFilter(Gate=Toggle(True), Stream0="0.5 * Pi", Stream1=neg_5)
xy_27 = XYPlane(Origin=end_7.End)
rotate_14 = Rotate(Geometry=ln_25, Angle=filter_18, Plane=xy_27)  # -> Geometry, Transform
pl_6 = ConstructPlane(Origin=end_7.End, XAxis=rotate_14.Geometry, YAxis=ln_25)

dist_6 = Distance(PointA=graft(end_7.End), PointB=item_26)
sort_16 = SortList(Keys=dist_6)  # -> Keys, ValuesA
item_35 = ListItem(List=sort_16.Keys, Index=0, Wrap=True)
smaller_8 = SmallerThan(FirstNumber=item_35, SecondNumber=Slider(100, range=0..300))  # -> SmallerThan, OrEqualTo
flatten_15 = FlattenTree(Tree=item_35, Path="{0}")
dispatch_25 = Dispatch(List=graft(pl_6), DispatchPattern=smaller_8.SmallerThan)  # -> ListA, ListB
panel_38 = Panel(flatten_15)

data_37 = Data(flatten(dispatch_25.ListA))
deplane_22 = DeconstructPlane(Plane=data_37)  # -> Origin, XAxis, YAxis, ZAxis
amp_15 = Amplitude(Vector=deplane_22.YAxis, Amplitude=Slider(300, range=0..1000))
move_26 = Move(Geometry=deplane_22.Origin, Motion=amp_15)  # -> Geometry, Transform
ln_26 = Line(StartPoint=deplane_22.Origin, EndPoint=move_26.Geometry)
midpt_21 = CurveMiddle(Curve=ln_26)
scale_12 = Scale(Geometry=ln_26, Center=midpt_21, Factor=Slider(1.5, range=0..10))  # -> Geometry, Transform
ccx_14 = CurveCurve(CurveA=graft(scale_12.Geometry), CurveB=crv_49)  # -> flatten(Points), ParamsA, ParamsB

data_38 = Data(flatten(dispatch_25.ListB))
deplane_23 = DeconstructPlane(Plane=data_38)  # -> Origin, XAxis, YAxis, ZAxis
amp_16 = Amplitude(Vector=deplane_23.YAxis, Amplitude=Slider(300, range=0..1000))
move_27 = Move(Geometry=deplane_23.Origin, Motion=amp_16)  # -> Geometry, Transform
ln_27 = Line(StartPoint=deplane_23.Origin, EndPoint=move_27.Geometry)
midpt_22 = CurveMiddle(Curve=ln_27)
scale_13 = Scale(Geometry=ln_27, Center=midpt_22, Factor=Slider(1.5, range=0..10))  # -> Geometry, Transform
ccx_15 = CurveCurve(CurveA=graft(scale_13.Geometry), CurveB=crv_49)  # -> flatten(Points), ParamsA, ParamsB

# ----
# SmoothCurve-阳角
move2pt_14 = MoveToPoint(Geometry=data_37, PointA=deplane_22.Origin, PointB=ccx_14.Points)  # -> Moved, Vector, Transform

# ----
# SmoothCurve-阴角
move2pt_15 = MoveToPoint(Geometry=data_38, PointA=deplane_23.Origin, PointB=ccx_15.Points)  # -> Moved, Vector, Transform

# ----
# SmoothCurve-正常
pl_7 = ConstructPlane(Origin=move_25.Geometry, XAxis=ln_24, YAxis=rotate_13.Geometry)

merge_14 = Merge(
    Data1=move2pt_6.Moved,
    Data2=move2pt_7.Moved,
    Data3=move2pt_8.Moved,
    Data4=filter_14,
    Data5=filter_15,
    Data6=filter_16,
    Data7=move2pt_14.Moved,
    Data8=move2pt_15.Moved,
    Data9=pl_7,
    Data10=pl_4,
    Data11=pl,
    Data12=pl_5)  # -> flatten(Result)

# ----
# 1.是否有檐口线
clean_3 = CleanTree(RemoveNulls=True, RemoveInvalid=True, RemoveEmpty=Toggle(True), Tree=merge_14)
deplane_24 = DeconstructPlane(Plane=clean_3)  # -> Origin, XAxis, YAxis, ZAxis
incurve = PointInCurve(Point=deplane_24.Origin, Curve=crv_15)  # -> Relationship, Point
equals_2 = Equality(FirstNumber=incurve.Relationship, SecondNumber="2")  # -> Equality, Inequality
dispatch_26 = Dispatch(List=clean_3, DispatchPattern=equals_2.Equality)  # -> ListA, ListB

# ----
# 1.2无檐口线
pln_19 = Plane(dispatch_26.ListB)

# ----
# 1.1有檐口线
pln_20 = Plane(dispatch_26.ListA)

number_slider_23 = Slider(1000, range=0..1000)
number_slider_24 = Slider(3000, range=0..10000)
deplane_25 = DeconstructPlane(Plane=pln_20)  # -> Origin, XAxis, YAxis, ZAxis
amp_17 = Amplitude(Vector=deplane_25.YAxis, Amplitude=expr("-x", number_slider_23))
amp_18 = Amplitude(Vector=deplane_25.YAxis, Amplitude=number_slider_24)
move_28 = Move(Geometry=deplane_25.Origin, Motion=amp_17)  # -> Geometry, Transform
move_29 = Move(Geometry=deplane_25.Origin, Motion=amp_18)  # -> Geometry, Transform

# ----
# 定位点生成定位线
ln_28 = Line(StartPoint=move_28.Geometry, EndPoint=move_29.Geometry)

# ----
# 1.1.1与梁不相交
ccx_16 = CurveCurve(CurveA=graft(ln_28), CurveB=line)  # -> Points, ParamsA, ParamsB
pull_26 = PullPoint(Point=ccx_16.Points, Geometry=deplane_25.Origin, ClosestOnly=True)  # -> flatten(ClosestPoint), Distance
cullduppoints_5 = RemoveDuplicatePoints(InputPoints=pull_26.ClosestPoint, Tolerance=0.001)  # -> OutputPoints, FirstPointIndexes
null_7 = NullItem(Item=cullduppoints_5.OutputPoints)  # -> NullFlags, InvalidFlags, Description
dispatch_27 = Dispatch(List=cullduppoints_5.OutputPoints, DispatchPattern=null_7.InvalidFlags)  # -> ListA, ListB
data_39 = Data(dispatch_27.ListB)
check_same_points_5 = CheckSamePoints(archPoint=deplane_25.Origin, crvPoint=data_39)  # -> out, specialPt; inputs archPoint: list of Point3d, crvPoint: list of Point3d; same code as testpoint
item_36 = ListItem(List=pln_20, Index=check_same_points_5.specialPt, Wrap=True)
deplane_26 = DeconstructPlane(Plane=item_36)  # -> Origin, XAxis, YAxis, ZAxis
amp_19 = Amplitude(Vector=deplane_26.YAxis, Amplitude=expr("-x", number_slider_23))
amp_20 = Amplitude(Vector=deplane_26.YAxis, Amplitude=number_slider_24)
move_30 = Move(Geometry=deplane_26.Origin, Motion=amp_19)  # -> Geometry, Transform
move_31 = Move(Geometry=deplane_26.Origin, Motion=amp_20)  # -> Geometry, Transform
ln_29 = Line(StartPoint=move_30.Geometry, EndPoint=move_31.Geometry)
ccx_17 = CurveCurve(CurveA=graft(ln_29), CurveB=line)  # -> flatten(Points), ParamsA, ParamsB
cullduppoints_6 = RemoveDuplicatePoints(InputPoints=ccx_17.Points, Tolerance=0.001)  # -> OutputPoints, FirstPointIndexes
null_8 = NullItem(Item=cullduppoints_6.OutputPoints)  # -> NullFlags, InvalidFlags, Description
dispatch_28 = Dispatch(List=cullduppoints_6.OutputPoints, DispatchPattern=null_8.NullFlags)  # -> ListA, ListB
pt_11 = Point(dispatch_28.ListB)
pull_27 = PullPoint(Point=deplane_26.Origin, Geometry=pt_11, ClosestOnly=True)  # -> ClosestPoint, Distance

# ----
# 1.1.1与梁相交
ccx_18 = CurveCurve(CurveA=graft(ln_28), CurveB=crv_25)  # -> Points, ParamsA, ParamsB
pull_28 = PullPoint(Point=ccx_18.Points, Geometry=deplane_25.Origin, ClosestOnly=True)  # -> flatten(ClosestPoint), Distance
check_same_points_6 = CheckSamePoints(archPoint=deplane_25.Origin, crvPoint=pull_28.ClosestPoint)  # -> out, specialPt; inputs archPoint: list of Point3d, crvPoint: list of Point3d; same code as testpoint
item_37 = ListItem(List=pln_20, Index=check_same_points_6.specialPt, Wrap=True)
deplane_27 = DeconstructPlane(Plane=item_37)  # -> Origin, XAxis, YAxis, ZAxis
amp_21 = Amplitude(Vector=deplane_27.YAxis, Amplitude=expr("-x", number_slider_23))
amp_22 = Amplitude(Vector=deplane_27.YAxis, Amplitude=number_slider_24)
move_32 = Move(Geometry=deplane_27.Origin, Motion=amp_21)  # -> Geometry, Transform
move_33 = Move(Geometry=deplane_27.Origin, Motion=amp_22)  # -> Geometry, Transform
ln_30 = Line(StartPoint=move_32.Geometry, EndPoint=move_33.Geometry)
ccx_19 = CurveCurve(CurveA=graft(ln_30), CurveB=crv_25)  # -> flatten(Points), ParamsA, ParamsB
cullduppoints_7 = RemoveDuplicatePoints(InputPoints=ccx_19.Points, Tolerance=0.001)  # -> OutputPoints, FirstPointIndexes
null_9 = NullItem(Item=cullduppoints_7.OutputPoints)  # -> NullFlags, InvalidFlags, Description
dispatch_29 = Dispatch(List=cullduppoints_7.OutputPoints, DispatchPattern=null_9.NullFlags)  # -> ListA, ListB
pt_12 = Point(dispatch_29.ListB)
pull_29 = PullPoint(Point=deplane_27.Origin, Geometry=pt_12, ClosestOnly=True)  # -> ClosestPoint, Distance

# ----
# 1.1.1定位点
# 与梁相交
move2pt_16 = MoveToPoint(Geometry=item_37, PointA=deplane_27.Origin, PointB=pull_29.ClosestPoint)  # -> Moved, Vector, Transform

# ----
# 1.1.1定位点
# 与梁不相交
# 如何处理？？
move2pt_17 = MoveToPoint(Geometry=item_36, PointA=deplane_26.Origin, PointB=pull_27.ClosestPoint)  # -> Moved, Vector, Transform

# ----
# 1.1.1布埋件
data_40 = Data(move2pt_16.Moved)

# ----
# 1.1.2布埋件
data_41 = Data(move2pt_17.Moved)

pln_21 = Plane(move2pt_16.Moved)
deplane_28 = DeconstructPlane(Plane=pln_21)  # -> Origin, XAxis, YAxis, ZAxis
amp_23 = Amplitude(Vector=deplane_28.YAxis, Amplitude=expr("-x", addition_3))
move_34 = Move(Geometry=deplane_28.Origin, Motion=amp_23)  # -> Geometry, Transform
move2pt_18 = MoveToPoint(Geometry=pln_21, PointA=deplane_28.Origin, PointB=move_34.Geometry)  # -> Moved, Vector, Transform
incurve_2 = PointInCurve(Point=move_34.Geometry, Curve=crv_28)  # -> Relationship, Point
equals_3 = Equality(FirstNumber=incurve_2.Relationship, SecondNumber="0")  # -> Equality, Inequality
dispatch_30 = Dispatch(List=move2pt_18.Moved, DispatchPattern=equals_3.Equality)  # -> ListA, ListB
pln_22 = Plane(dispatch_30.ListB)

# ----
# 1.2.1梁以内>350
# 
# 侧埋，钢板焊
pln_23 = Plane(dispatch_30.ListA)

pln_24 = Plane(pln_21)
number_slider_25 = Slider(3584, range=0..10000)
deplane_29 = DeconstructPlane(Plane=pln_24)  # -> Origin, XAxis, YAxis, ZAxis
amp_24 = Amplitude(Vector=deplane_29.YAxis, Amplitude=number_slider_25)
amp_25 = Amplitude(Vector=deplane_29.YAxis, Amplitude=expr("-x", number_slider_25))
move_35 = Move(Geometry=deplane_29.Origin, Motion=amp_25)  # -> Geometry, Transform
move_36 = Move(Geometry=deplane_29.Origin, Motion=amp_24)  # -> Geometry, Transform
ln_31 = Line(StartPoint=move_35.Geometry, EndPoint=move_36.Geometry)
ccx_20 = CurveCurve(CurveA=ln_31, CurveB=offset_10)  # -> Points, ParamsA, ParamsB
ccx_21 = CurveCurve(CurveA=ln_31, CurveB=offset_11)  # -> Points, ParamsA, ParamsB
ln_32 = Line(StartPoint=ccx_20.Points, EndPoint=ccx_21.Points)  # -> flatten(Line)
len_7 = Length(Curve=ln_32)
sort_17 = SortList(Keys=len_7)  # -> Keys, ValuesA
panel_39 = Panel(sort_17.Keys)
larger_8 = LargerThan(FirstNumber=len_7, SecondNumber=number_slider_9)  # -> LargerThan, OrEqualTo
dispatch_31 = Dispatch(List=ln_32, DispatchPattern=larger_8.LargerThan)  # -> ListA, ListB
line_2 = Line(dispatch_31.ListA)
line_3 = Line(dispatch_31.ListB)
ccx_22 = CurveCurve(CurveA=line_3, CurveB=merge_7)  # -> Points, ParamsA, ParamsB
pt_13 = Point(flatten(ccx_22.Points))
pull_30 = PullPoint(Point=deplane_29.Origin, Geometry=graft(pt_13), ClosestOnly=True)  # -> ClosestPoint, Distance
sort_18 = SortList(Keys=pull_30.Distance, ValuesA=pln_24)  # -> Keys, ValuesA
item_38 = ListItem(List=sort_18.ValuesA, Index=0, Wrap=True)  # -> flatten(Item)
check_same_points_7 = CheckSamePoints(archPoint=pln_24, crvPoint=item_38)  # -> out, specialPt; inputs archPoint: list of Point3d, crvPoint: list of Point3d; same code as testpoint
item_39 = ListItem(List=pln_24, Index=check_same_points_7.specialPt, Wrap=True)
deplane_30 = DeconstructPlane(Plane=item_39)  # -> Origin, XAxis, YAxis, ZAxis

pln_25 = Plane(pln_24)
number_slider_26 = Slider(3584, range=0..10000)
deplane_31 = DeconstructPlane(Plane=pln_25)  # -> Origin, XAxis, YAxis, ZAxis
amp_26 = Amplitude(Vector=deplane_31.YAxis, Amplitude=number_slider_26)
amp_27 = Amplitude(Vector=deplane_31.YAxis, Amplitude=expr("-x", number_slider_26))
move_37 = Move(Geometry=deplane_31.Origin, Motion=amp_27)  # -> Geometry, Transform
move_38 = Move(Geometry=deplane_31.Origin, Motion=amp_26)  # -> Geometry, Transform
ln_33 = Line(StartPoint=move_37.Geometry, EndPoint=move_38.Geometry)
ccx_23 = CurveCurve(CurveA=ln_33, CurveB=offset_8)  # -> Points, ParamsA, ParamsB
ccx_24 = CurveCurve(CurveA=ln_33, CurveB=offset_9)  # -> Points, ParamsA, ParamsB
ln_34 = Line(StartPoint=ccx_23.Points, EndPoint=ccx_24.Points)  # -> flatten(Line)
len_8 = Length(Curve=ln_34)
sort_19 = SortList(Keys=len_8)  # -> Keys, ValuesA
panel_40 = Panel(sort_19.Keys)
larger_9 = LargerThan(FirstNumber=len_8, SecondNumber=number_slider_10)  # -> LargerThan, OrEqualTo
dispatch_32 = Dispatch(List=ln_34, DispatchPattern=larger_9.LargerThan)  # -> ListA, ListB
line_4 = Line(dispatch_32.ListA)
line_5 = Line(dispatch_32.ListB)
ccx_25 = CurveCurve(CurveA=line_5, CurveB=merge_6)  # -> Points, ParamsA, ParamsB
pt_14 = Point(flatten(ccx_25.Points))
pull_31 = PullPoint(Point=deplane_31.Origin, Geometry=graft(pt_14), ClosestOnly=True)  # -> ClosestPoint, Distance
sort_20 = SortList(Keys=pull_31.Distance, ValuesA=pln_25)  # -> Keys, ValuesA
item_40 = ListItem(List=sort_20.ValuesA, Index=0, Wrap=True)  # -> flatten(Item)
check_same_points_8 = CheckSamePoints(archPoint=pln_25, crvPoint=item_40)  # -> out, specialPt; inputs archPoint: list of Point3d, crvPoint: list of Point3d; same code as testpoint
item_41 = ListItem(List=pln_25, Index=check_same_points_8.specialPt, Wrap=True)
pull_32 = PullPoint(Point=item_41, Geometry=pt_14, ClosestOnly=True)  # -> ClosestPoint, Distance
deplane_32 = DeconstructPlane(Plane=item_41)  # -> Origin, XAxis, YAxis, ZAxis

pull_33 = PullPoint(Point=deplane_30.Origin, Geometry=pt_13, ClosestOnly=True)  # -> ClosestPoint, Distance
cull_i_16 = CullIndex(List=pln_25, Indices=check_same_points_8.specialPt, Wrap=True)

# ----
# 1.2.3
# 内侧300-600mm
move2pt_19 = MoveToPoint(Geometry=item_41, PointA=deplane_32.Origin, PointB=pull_32.ClosestPoint)  # -> Moved, Vector, Transform

# ----
# 1.2.2
# 下层建筑边线外侧50-350mm
# 侧埋，钢板焊
move2pt_20 = MoveToPoint(Geometry=item_39, PointA=deplane_30.Origin, PointB=pull_33.ClosestPoint)  # -> Moved, Vector, Transform

# ---- group: 大面
# 大面埋件布置
number_slider_27 = Slider(0.002, range=0..0.01)
filter_19 = StreamFilter(Gate=list_2, Stream0=expression_4, Stream1=number_slider_27)
filter_20 = StreamFilter(Gate=list, Stream0=filter_19, Stream1=expression_4, Stream2=filter_19)
offset_17 = OffsetCurve(Curve=offset, Distance=expr("-x", filter_20), Plane=PlaneXY(0, 0, 0), Corners=1)

# ---- group: 阴阳角区分 (continued)
crv_cp_6 = CurveClosestPoint(Point=item_17, Curve=offset_17)  # -> Point, Parameter, Distance
vec2pt_2 = Vector2Pt(PointA=crv_cp_6.Point, PointB=crv_cp_2.Point, Unitize=False)  # -> expr("-x", Vector), Length
angle_3 = Angle(VectorA=eval_2.Tangent, VectorB=vec2pt_2.Vector)  # -> Angle, Reflex
deg_6 = Degrees(Radians=angle_3.Angle)
smaller_9 = SmallerThan(FirstNumber=deg_6, SecondNumber=89)  # -> SmallerThan, OrEqualTo
dispatch_33 = Dispatch(List=item_17, DispatchPattern=smaller_9.SmallerThan)  # -> ListA, ListB

# ---- group: 正常+阳角+阴角区分 (continued)
data_42 = Data(dispatch_33.ListA)
data_43 = Data(dispatch_33.ListB)
pull_34 = PullPoint(Point=data_42, Geometry=crv_39, ClosestOnly=True)  # -> ClosestPoint, Distance
pull_35 = PullPoint(Point=data_43, Geometry=crv_40, ClosestOnly=True)  # -> ClosestPoint, Distance
c_script_3 = CSharpScript(archPoint=pull_34.ClosestPoint, crvPoint=explode_4.Vertices)  # -> out, specialPt; inputs archPoint: list of Point3d, crvPoint: list of Point3d; same code as testpoint
c_script_4 = CSharpScript(archPoint=pull_35.ClosestPoint, crvPoint=explode_5.Vertices)  # -> out, specialPt; inputs archPoint: list of Point3d, crvPoint: list of Point3d; same code as testpoint
cull_i_17 = CullIndex(List=data_42, Indices=c_script_3.specialPt, Wrap=True)

# ---- group: 阴角定位-细化 (continued)
dispatch_34 = Dispatch(List=item_24, DispatchPattern=smaller_9.SmallerThan)  # -> ListA, ListB
item_42 = ListItem(List=dispatch_34.ListB, Index=c_script_4.specialPt, Wrap=True)
join_2 = JoinCurves(Curves=item_42, Preserve=False)
explode_8 = Explode(Curve=join_2, Recursive=True)  # -> Segments, Vertices
crv_50 = Curve(simplify(explode_8.Segments))
len_9 = Length(Curve=crv_50)
sort_21 = SortList(Keys=len_9, ValuesA=crv_50)  # -> Keys, ValuesA
item_43 = ListItem(List=sort_21.ValuesA, Index=0, Wrap=True)  # -> Item2, Item1, Item
crv_51 = Curve([item_43.Item2, item_43.Item1])
disc_13 = Discontinuity(Curve=crv_51, Level=1)  # -> Points, Parameters
item_44 = ListItem(List=disc_13.Points, Index=0, Wrap=True)
pull_36 = PullPoint(Point=disc_13.Points, Geometry=pt_2, ClosestOnly=True)  # -> ClosestPoint, Distance
crv_cp_7 = CurveClosestPoint(Point=disc_13.Points, Curve=offset)  # -> Point, Parameter, Distance
sort_22 = SortList(Keys=pull_36.Distance, ValuesA=crv_cp_7.Point)  # -> Keys, ValuesA

# ---- group: 正常+阳角+阴角区分 / 正常-遗漏
cull_i_18 = CullIndex(List=data_43, Indices=c_script_4.specialPt, Wrap=True)

# ---- group: 正常+阳角+阴角区分 / 阴角定位点
item_45 = ListItem(List=data_43, Index=c_script_4.specialPt, Wrap=True)

# ---- group: 正常+阳角+阴角区分 / 正常定位点
merge_15 = Merge(Data1=cull_i_7, Data2=cull_i_18, Data3=cull_i_17)

# ---- group: 正常+阳角+阴角区分 / 阳角定位点
item_46 = ListItem(List=data_42, Index=c_script_3.specialPt, Wrap=True)

# ---- group: 阴角定位-细化 / 阴角-2点定位
item_47 = ListItem(List=sort_22.ValuesA, Index=0, Wrap=True)

# ----
# 阳角埋件布置
pt_15 = Point(item_46)
explode_9 = Explode(Curve=crv_22, Recursive=True)  # -> Segments, Vertices
cp_2 = ClosestPoint(Point=pt_15, Cloud=explode_9.Vertices)  # -> ClosestPoint, CPIndex, Distance
cir_3 = Circle(Plane=cp_2.ClosestPoint, Radius=Slider(150, range=0..1000))
pt_16 = Point(cp_2.ClosestPoint)
ccx_26 = CurveCurve(CurveA=cir_3, CurveB=offset)  # -> Points, ParamsA, ParamsB
item_48 = ListItem(List=ccx_26.Points, Index=0, Wrap=True)  # -> Item, Item1
ln_35 = Line(StartPoint=graft(pt_16), EndPoint=graft(item_48.Item))  # -> flatten(Line)
ln_36 = Line(StartPoint=graft(pt_16), EndPoint=graft(item_48.Item1))  # -> flatten(Line)
item_49 = ListItem(List=filter_13, Index="1", Wrap=True)
pl_8 = ConstructPlane(Origin=pt_16, XAxis=ln_35, YAxis=ln_36)
bbox_6 = BoundingBox(Content=graft(item_49), Plane=PlaneXY(0, 0, 0))  # -> Box, Box_2
srf = Surface(bbox_6.Box)
explode_10 = Explode(Curve=srf, Recursive=True)  # -> Segments, Vertices
item_50 = ListItem(List=explode_10.Vertices, Index=0, Wrap=True)  # -> Item, Item1, Item2
ln_37 = Line(StartPoint=graft(item_50.Item1), EndPoint=graft(item_50.Item2))
ln_38 = Line(StartPoint=graft(item_50.Item1), EndPoint=graft(item_50.Item))
ln_39 = Line(StartPoint=graft(item_50.Item1), EndPoint=graft(item_50.Item))
ln_40 = Line(StartPoint=graft(item_50.Item1), EndPoint=graft(item_50.Item2))
pl_9 = ConstructPlane(Origin=item_50.Item1, XAxis=ln_40, YAxis=ln_39)
pl_10 = ConstructPlane(Origin=item_50.Item1, XAxis=ln_38, YAxis=ln_37)
orient_6 = Orient(Geometry=item_49, Source=pl_10, Target=pl_8)  # -> Geometry, Transform
orient_7 = Orient(Geometry=item_49, Source=pl_9, Target=pl_8)  # -> Geometry, Transform
merge_16 = Merge(Data1=orient_6.Geometry, Data2=orient_7.Geometry)
filter_21 = StreamFilter(Gate=list_2, Stream0=orient_6.Geometry, Stream1=merge_16)
bbox_7 = BoundingBox(Content=filter_21, Plane=PlaneXY(0, 0, 0))  # -> Box, Box_2
entwine_13 = Entwine(Branch00=filter_21, Branch01=bbox_7.Box, FlattenInputs=True)
flip_3 = FlipMatrix(Data=entwine_13)
item_51 = ListItem(List=flip_3, Index=-1, Wrap=True)  # -> flatten(Item)
item_52 = ListItem(List=flip_3, Index="0", Wrap=True)  # -> flatten(Item)

# ---- group: 阴角
# 阴角埋件布置
explode_11 = Explode(Curve=crv_22, Recursive=True)  # -> Segments, Vertices
cp_3 = ClosestPoint(Point=item_45, Cloud=explode_11.Vertices)  # -> ClosestPoint, CPIndex, Distance
pshift_6 = ShiftPaths(Data=item_47, Offset=-1)
crv_cp_8 = CurveClosestPoint(Point=pshift_6, Curve=offset_17)  # -> Point, Parameter, Distance
crv_cp_9 = CurveClosestPoint(Point=pshift_6, Curve=offset)  # -> Point, Parameter, Distance
vec2pt_3 = Vector2Pt(PointA=crv_cp_8.Point, PointB=crv_cp_9.Point, Unitize=False)  # -> expr("-x", Vector), Length
eval_6 = EvaluateCurve(Curve=offset, Parameter=crv_cp_9.Parameter)  # -> Point, Tangent, Angle
pl_11 = ConstructPlane(Origin=crv_cp_9.Point, XAxis=eval_6.Tangent, YAxis=vec2pt_3.Vector)
orient_8 = Orient(Geometry=block, Source=PlaneXY(0, 0, 0), Target=pl_11)  # -> Geometry, Transform

# ---- group: 大面 (continued)
crv_cp_10 = CurveClosestPoint(Point=merge_15, Curve=offset_17)  # -> Point, Parameter, Distance
crv_cp_11 = CurveClosestPoint(Point=merge_15, Curve=offset)  # -> Point, Parameter, Distance
vec2pt_4 = Vector2Pt(PointA=crv_cp_10.Point, PointB=crv_cp_11.Point, Unitize=False)  # -> expr("-x", Vector), Length
eval_7 = EvaluateCurve(Curve=offset, Parameter=crv_cp_11.Parameter)  # -> Point, Tangent, Angle
pl_12 = ConstructPlane(Origin=crv_cp_11.Point, XAxis=eval_7.Tangent, YAxis=vec2pt_4.Vector)
orient_9 = Orient(Geometry=block, Source=PlaneXY(0, 0, 0), Target=pl_12)  # -> flatten(Geometry), Transform

# ---- group: Datea / 2
lng_3 = ListLength(List=orient_9.Geometry)
division_10 = Division(A=lng_3, B=2)
split_2 = SplitList(List=orient_9.Geometry, Index=division_10)  # -> ListA, ListB
data_44 = Data(split_2.ListA)

# ----
bbox_8 = BoundingBox(Content=data_44, Plane=PlaneXY(0, 0, 0))  # -> Box, Box_2
entwine_14 = Entwine(Branch00=data_44, Branch01=bbox_8.Box, FlattenInputs=True)
flip_4 = FlipMatrix(Data=entwine_14)
item_53 = ListItem(List=flip_4, Index=-1, Wrap=True)  # -> flatten(Item)
item_54 = ListItem(List=flip_4, Index="0", Wrap=True)  # -> flatten(Item)
阴角 = Geometry(orient_8.Geometry)

# ---- group: Monomer + Side/Top / Monomer Type
filter_22 = StreamFilter(Gate=list, Stream0=item_51, Stream1=item_51, Stream2=item_51)

# ----
# 槽埋-角部倾斜时
bbox_9 = BoundingBox(Content=item_51, Plane=PlaneXY(0, 0, 0))  # -> Box, Box_2
ln_41 = Line(StartPoint=pt_15, EndPoint=pt_16)
debrep = DeconstructBrep(Brep=bbox_9.Box)  # -> Faces, Edges, Vertices
deplane_33 = DeconstructPlane(Plane=ln_41)  # -> Origin, XAxis, YAxis, ZAxis
len_10 = Length(Curve=debrep.Edges)
sort_23 = SortList(Keys=len_10, ValuesA=debrep.Edges)  # -> Keys, reverse(ValuesA)
amp_28 = Amplitude(Vector=deplane_33.XAxis, Amplitude=Slider(63.5, range=10..100))
item_55 = ListItem(List=sort_23.ValuesA, Index=0, Wrap=True)  # -> Item, Item1, Item2
item_56 = ListItem(List=sort_23.ValuesA, Index=0, Wrap=True)
move_39 = Move(Geometry=deplane_33.Origin, Motion=amp_28)  # -> Geometry, Transform
len_11 = Length(Curve=item_56)
end_8 = EndPoints(Curve=item_55.Item2)  # -> Start, End
end_9 = EndPoints(Curve=item_55.Item1)  # -> Start, End
ln_42 = Line(StartPoint=deplane_33.Origin, EndPoint=move_39.Geometry)
ln_43 = Line(StartPoint=move_39.Geometry, EndPoint=deplane_33.Origin)
avr = Average(Input=[end_9.Start, end_9.End])
ln_44 = Line(StartPoint=end_8.Start, EndPoint=end_8.End)
ln_45 = Line(StartPoint=end_9.Start, EndPoint=avr)
c_script_5 = CSharpScript(iReset=Toggle(True), turns=Slider(30, range=0..100), steps=Slider(10, range=0..10))  # -> out, num; inputs numDefault: Double, iReset: Boolean, turns: Int32, steps: Double
# ---------- c_script_5: C# ----------
    if(iReset){
      number = 0;}

    for(int i = 0; i < turns;i++){
      number = number + steps;
      numStore.Add(number);
      Print(number.ToString());}

    num = numStore;
# ---------- c_script_5: C# additional code ----------
  double number = 0;
  List <double> numStore = new List<double>();
# ---------- end c_script_5 ----------
pl_13 = ConstructPlane(Origin=avr, XAxis=ln_45, YAxis=ln_44)
panel_41 = Panel(c_script_5.num)
amp_29 = Amplitude(Vector=ln_41, Amplitude=graft(c_script_5.num))

item_57 = ListItem(List=flatten(len_11), Index=0, Wrap=True)

ln_46 = Line(StartPoint=pt_15, EndPoint=pt_16)
move_40 = Move(Geometry=pt_16, Motion=ln_46)  # -> Geometry, Transform
ccx_27 = CurveCurve(CurveA=cir_3, CurveB=offset)  # -> Points, ParamsA, ParamsB
item_58 = ListItem(List=ccx_27.Points, Index=0, Wrap=True)  # -> flatten(Item), flatten(Item1)
ln_47 = Line(StartPoint=pt_16, EndPoint=item_58.Item)
ln_48 = Line(StartPoint=pt_16, EndPoint=move_40.Geometry)
ln_49 = Line(StartPoint=pt_16, EndPoint=item_58.Item1)
angle_4 = Angle(VectorA=ln_47, VectorB=ln_48)  # -> Angle, Reflex
angle_5 = Angle(VectorA=ln_49, VectorB=ln_48)  # -> Angle, Reflex
deg_7 = Degrees(Radians=angle_4.Angle)
deg_8 = Degrees(Radians=angle_5.Angle)
item_59 = ListItem(List=ln_48, Index=Slider(3, range=0..4), Wrap=True)
tan = Tangent(Value=degrees(deg_7))
entwine_15 = Entwine(Branch00=ln_47, Branch01=tan, FlattenInputs=True)
tan_2 = Tangent(Value=degrees(deg_8))
division_11 = Division(A=tan, B=tan_2)
panel_42 = Panel(deg_8)
panel_43 = Panel(deg_7)
addition_8 = Addition(A=division_11, B=1)
division_12 = Division(A="1", B=addition_8)
subtraction = Subtraction(A="1", B=division_12)
num = Number(division_12)
larger_10 = LargerThan(FirstNumber=tan, SecondNumber=tan_2)  # -> LargerThan, OrEqualTo

amp_30 = Amplitude(Vector=ln_43, Amplitude=expr("x/2", flatten(item_57)))
amp_31 = Amplitude(Vector=ln_42, Amplitude=expr("x/2", flatten(item_57)))
move_41 = Move(Geometry=pt_16, Motion=amp_30)  # -> Geometry, Transform
move_42 = Move(Geometry=pt_16, Motion=amp_31)  # -> Geometry, Transform
ln_50 = Line(StartPoint=move_41.Geometry, EndPoint=move_42.Geometry)

crv_52 = Curve(ln_50)
mp = Midpoint(Curve=crv_52)
eval_8 = EvaluateCurve(Curve=crv_52, Parameter=subtraction)  # -> Point, Tangent, Angle
eval_9 = EvaluateCurve(Curve=crv_52, Parameter=num)  # -> Point, Tangent, Angle
dispatch_35 = Dispatch(List=eval_8.Point, DispatchPattern=larger_10.OrEqualTo)  # -> ListA, ListB
dispatch_36 = Dispatch(List=eval_9.Point, DispatchPattern=larger_10.OrEqualTo)  # -> ListA, ListB
pt_17 = Point(dispatch_35.ListB)
pt_18 = Point(dispatch_36.ListA)
merge_17 = Merge(Data1=pt_18, Data2=pt_17)
pull_37 = PullPoint(Point=merge_17, Geometry=graft(mp), ClosestOnly=True)  # -> ClosestPoint, Distance
panel_44 = Panel(merge_17)
sort_24 = SortList(Keys=pull_37.Distance, ValuesA=merge_17)  # -> Keys, ValuesA
item_60 = ListItem(List=sort_24.ValuesA, Index=0, Wrap=True)  # -> flatten(Item)
ln_51 = Line(StartPoint=item_60, EndPoint=mp)
panel_45 = Panel(item_60)
move_43 = Move(Geometry=crv_52, Motion=ln_51)  # -> Geometry, Transform

# ---- group: 正常和阳角 - BoundingBox — 测Intersection
entwine_16 = Entwine(Branch00=flip.Curve, Branch01=offset, FlattenInputs=True)
flip_5 = FlipMatrix(Data=entwine_16)
item_61 = ListItem(List=flip_5, Index=0, Wrap=True)  # -> Item, Item1

# ----
move_44 = Move(Geometry=move_43.Geometry, Motion=amp_29)  # -> Geometry, Transform
ccx_28 = CurveCurve(CurveA=move_44.Geometry, CurveB=crv_22)  # -> Points, ParamsA, ParamsB
item_62 = ListItem(List=ccx_28.Points, Index=0, Wrap=True)
item_63 = ListItem(List=ccx_28.Points, Index="-1", Wrap=True)
pshift_7 = ShiftPaths(Data=item_62, Offset=-1)
pshift_8 = ShiftPaths(Data=item_63, Offset=-1)
flip_6 = FlipMatrix(Data=pshift_7)
flip_7 = FlipMatrix(Data=pshift_8)
pt_19 = Point(flip_6)
pt_20 = Point(flip_7)
pull_38 = PullPoint(Point=pt_19, Geometry=graft(mp), ClosestOnly=True)  # -> ClosestPoint, Distance
pull_39 = PullPoint(Point=pt_20, Geometry=graft(mp), ClosestOnly=True)  # -> ClosestPoint, Distance
sort_25 = SortList(Keys=pull_38.Distance, ValuesA=pt_19)  # -> Keys, ValuesA
sort_26 = SortList(Keys=pull_39.Distance, ValuesA=pt_20)  # -> Keys, ValuesA
item_64 = ListItem(List=sort_25.ValuesA, Index="-1", Wrap=True)
item_65 = ListItem(List=sort_26.ValuesA, Index="-1", Wrap=True)
ln_52 = Line(StartPoint=item_65, EndPoint=item_64)

end_10 = EndPoints(Curve=ln_52)  # -> Start, End

avr_2 = Average(Input=[end_10.Start, end_10.End])
pl_14 = ConstructPlane(Origin=avr_2, XAxis=ln_52, YAxis=graft(ln_41))
orient_10 = Orient(Geometry=graft(item_52), Source=pl_13, Target=pl_14)  # -> Geometry, Transform
orient_11 = Orient(Geometry=graft(item_51), Source=pl_13, Target=pl_14)  # -> Geometry, Transform

filter_23 = StreamFilter(Gate=list_8, Stream0=item_51, Stream1=orient_11.Geometry)

# ---- group: Monomer + Side/Top / Monomer Type (continued)
filter_24 = StreamFilter(Gate=list, Stream0=item_51, Stream1=filter_23, Stream2=item_51)

# ---- group: Monomer + Side/Top / Top/Side
filter_25 = StreamFilter(Gate=list_2, Stream0=filter_24, Stream1=filter_22)

# ----
filter_26 = StreamFilter(Gate=list_8, Stream0=item_52, Stream1=orient_10.Geometry)

# ---- group: 阳角分类
filter_27 = StreamFilter(Gate=list, Stream0=item_52, Stream1=filter_26, Stream2=item_52)
filter_28 = StreamFilter(Gate=list, Stream0=item_52, Stream1=item_52, Stream2=item_52)
filter_29 = StreamFilter(Gate=list_2, Stream0=filter_27, Stream1=filter_28)

# ----
阳角 = Geometry(filter_29)

# ---- group: 正常和阳角 - BoundingBox — 测Intersection (continued)
c_script_6 = CSharpScript(BrepMain=item_53, BrepStay=filter_25)  # -> out, BrepInters, BrepRemain, IndexM, IndexS; inputs BrepMain: list of Brep, BrepStay: list of Brep
# ---------- c_script_6: C# ----------
    List<Brep> BrepI = new List<Brep>();
    List<Brep> BrepR = new List<Brep>();
    List<int> num = new List<int>();
    List<int> numS = new List<int>();


    double tolr = Rhino.RhinoDoc.ActiveDoc.ModelAbsoluteTolerance;

    for(int j = 0; j < BrepMain.Count;j++){
      for(int i = 0; i < BrepStay.Count;i++){
        bool test = Rhino.Geometry.Intersect.Intersection.BrepBrep(BrepMain[j], BrepStay[i], tolr, out crv, out pts);
        if(test && crv.Length != 0){
          tryThis = true;
          numS.Add(i);
          break;}
        else{
          tryThis = false;}
      }
      if(tryThis){
        BrepI.Add(BrepMain[j]);
        num.Add(j);
      }
      else{
        BrepR.Add(BrepMain[j]);
      }
    }



    BrepInters = BrepI;
    BrepRemain = BrepR;
    IndexM = num;
    IndexS = numS;
# ---------- c_script_6: C# additional code ----------
  Rhino.Geometry.Curve[] crv;
  Rhino.Geometry.Point3d[] pts;
  bool tryThis;
# ---------- end c_script_6 ----------
item_66 = ListItem(List=item_53, Index=c_script_6.IndexM, Wrap=True)  # -> graft(Item)
item_67 = ListItem(List=filter_25, Index=c_script_6.IndexS, Wrap=True)  # -> graft(Item)
cull_i_19 = CullIndex(List=item_54, Indices=c_script_6.IndexM, Wrap=True)
item_68 = ListItem(List=item_54, Index=c_script_6.IndexM, Wrap=True)  # -> graft(Item)
area_14 = Area(Geometry=item_66)  # -> Area, Centroid
bbx = BrepBrep(BrepA=item_66, BrepB=item_67)  # -> simplify(Curves), Points
area_15 = Area(Geometry=bbx.Curves)  # -> Area, Centroid
ln_53 = Line(StartPoint=area_14.Centroid, EndPoint=area_15.Centroid)
mp_2 = Midpoint(Curve=ln_53)
scale_14 = Scale(Geometry=ln_53, Center=mp_2, Factor=Slider(1000000, range=0..1000000))  # -> Geometry, Transform
ccx_29 = CurveCurve(CurveA=scale_14.Geometry, CurveB=bbx.Curves)  # -> Points, ParamsA, ParamsB
item_69 = ListItem(List=ccx_29.Points, Index=0, Wrap=True)  # -> Item, Item1
ln_54 = Line(StartPoint=item_69.Item1, EndPoint=item_69.Item)
move_45 = Move(Geometry=item_68, Motion=ln_54)  # -> simplify(Geometry), Transform
bbox_10 = BoundingBox(Content=move_45.Geometry, Plane=PlaneXY(0, 0, 0))  # -> Box, Box_2

# ----
# 这里如果跑红也不要紧，
# 说明单体没有出现相撞的情况
area_16 = Area(Geometry=bbox_10.Box)  # -> Area, Centroid

# ---- group: 正常和阳角 - BoundingBox — 测Intersection (continued)
entwine_17 = Entwine(Branch00=move_45.Geometry, Branch01=area_16.Centroid, FlattenInputs=True)
flip_8 = FlipMatrix(Data=entwine_17)
item_70 = ListItem(List=flip_8, Index="0", Wrap=True)  # -> flatten(Item)
item_71 = ListItem(List=flip_8, Index="-1", Wrap=True)  # -> flatten(Item)
pull_40 = PullPoint(Point=item_71, Geometry=item_61.Item, ClosestOnly=True)  # -> flatten(ClosestPoint), Distance
pull_41 = PullPoint(Point=item_71, Geometry=item_61.Item1, ClosestOnly=True)  # -> flatten(ClosestPoint), Distance
vec2pt_5 = Vector2Pt(PointA=item_71, PointB=pull_40.ClosestPoint, Unitize=False)  # -> Vector, Length
vec2pt_6 = Vector2Pt(PointA=item_71, PointB=pull_41.ClosestPoint, Unitize=False)  # -> Vector, Length
multiplication_13 = Multiplication(A=vec2pt_5.Vector, B=vec2pt_6.Vector)
larger_11 = LargerThan(FirstNumber=multiplication_13, SecondNumber=0)  # -> LargerThan, OrEqualTo
dispatch_37 = Dispatch(List=item_70, DispatchPattern=larger_11.LargerThan)  # -> ListA, ListB

# ---- group: Normal
geo_7 = Geometry(cull_i_19)

# ---- group: Normal-Move
移动 = Geometry(dispatch_37.ListA)

# ----
# PLAN Results
merge_18 = Merge(Data1=geo_7, Data2=阳角, Data3=移动, Data4=阴角)

# ==== cluster Cluster
G = ClusterInput()
rotate = Rotate(Geometry=G, Angle=3.141592654, Plane=PlaneXY(0, 0, 0))  # -> Geometry, Transform
boxprop = BoxProperties(Box=rotate.Geometry)  # -> Center, Diagonal, Area, Volume, Degeneracy
bbox = BoundingBox(Content=rotate.Geometry, Plane=PlaneXY(0, 0, 0))  # -> Box, Box_2
debox = DeconstructBox(Box=bbox.Box)  # -> Plane, X, Y, Z
pdecon = Deconstruct(Point=boxprop.Center)  # -> XComponent, YComponent, ZComponent
dedomain = DeconstructDomain(Domain=debox.Y)  # -> Start, End
pt = ConstructPoint(XCoordinate=pdecon.XComponent, YCoordinate=dedomain.Start, ZCoordinate=pdecon.ZComponent)
xy = XYPlane(Origin=Point(0, 0, 0))
pl_origin = PlaneOrigin(Base=xy, Origin=pt)
orient = Orient(Geometry=rotate.Geometry, Source=pl_origin, Target=xy)  # -> Geometry, Transform
G_2 = ClusterOutput(orient.Geometry)
